# Dynamo graph script.dyn "Витражи - №6_Запись изображений" (Dynamo 2.12.1.8246)

# group: ОПИСАНИЕ! ПРОЧИТАТЬ ПЕРЕД ЗАПУСКОМ!
# note: Скрипт "Витражи - №6_Запись изображений"
# Версия 2.1
# Разработал: Козлов Павел
# ЧТО ДЕЛАЕТ:
# Экспортирует изображения чертежных видов с витражами, импортирует их в проект и вставляет в соответствующие витражи в соответствии с именем группы
# КАК ПОЛЬЗОВАТЬСЯ:
# 1. Обязательно удалить ранее созданные изображения.
# 2. Нажать "Запуск"

запись_изображений = Python()  # IronPython2
# ---------- запись_изображений.python (127 lines) ----------
import clr
clr.AddReference('ProtoGeometry')
clr.AddReference("System.Windows.Forms")
from Autodesk.DesignScript.Geometry import *
clr.AddReference("RevitServices")
import RevitServices
from RevitServices.Persistence import DocumentManager
from RevitServices.Transactions import TransactionManager
clr.AddReference("RevitAPI")
import Autodesk
from Autodesk.Revit.DB import *
from System.Collections.Generic import *
from operator import itemgetter
clr.AddReference("RevitNodes")
import Revit
clr.ImportExtensions(Revit.Elements)
import itertools
from itertools import groupby
import os


# Функция, которая из всех выделенных групп, берет по одной
def group_instance (list_id):
	
	all_elements = []	
	for id in list_id:	
		noname_element = doc.GetElement(id)		
		if "Группы модели" == noname_element.Category.Name:		
			all_elements.append(noname_element)
		
	groups = {}		
	for group in all_elements:
		groupby_value = group.Name
					
		if groupby_value in groups:
			groups[groupby_value].append(group)				
		else:
			groups[groupby_value] = [group]	
	
	elements = []	
	for element in groups.Values:
		elements.append(element[0])
	
	return elements
	

def export_view (view):

	doc_name = 'Эскиз_Витража'
	output_path = os.path.dirname(doc.PathName) 

	if not os.path.exists(output_path):
		output_path = os.path.join(os.path.join(os.environ['USERPROFILE']),'Desktop') 
    
	oc_name = os.path.basename(doc.PathName)  
	filePath = os.path.join(output_path, doc_name)
	
	ids = [view.Id]
	viewIds = List[ElementId](ids)

	ieo = ImageExportOptions()
	ieo.ExportRange = ExportRange.SetOfViews
	ieo.SetViewsAndSheets(viewIds)
	ieo.FilePath = filePath
	ieo.HLRandWFViewsFileType = ImageFileType.PNG
	ieo.ImageResolution = ImageResolution.DPI_300
	ieo.FitDirection = FitDirectionType.Horizontal
	ieo.PixelSize = 1800
	ieo.ShadowViewsFileType = ImageFileType.PNG
	ieo.ZoomType = ZoomFitType.FitToPage
	doc.ExportImage(ieo)

	images_fullpath = filePath + ieo.GetFileName(doc, view.Id) + "." + ieo.HLRandWFViewsFileType.ToString()
	
	return images_fullpath


def import_view (path, doc):
	
	its = ImageTypeSource.Import
	ito = ImageTypeOptions(path, False, its)	
	im_type = ImageType.Create(doc, ito)
	
	return im_type	

# --------------------------------------------------------------------------------------------

doc = DocumentManager.Instance.CurrentDBDocument
uiapp = DocumentManager.Instance.CurrentUIApplication
app = uiapp.Application
uidoc = DocumentManager.Instance.CurrentUIApplication.ActiveUIDocument


# Выбераем элементы в модели
selected_ids = uidoc.Selection.GetElementIds()

# Отделяем только по одному экземпляру из всех выделенных групп
all_groups = group_instance (selected_ids)


prefix = 'Эскиз_Витража_'

#коллектор всех видов
all_views = FilteredElementCollector(doc).OfCategory(BuiltInCategory.OST_Views) 

	
TransactionManager.Instance.EnsureInTransaction(doc) 

selected_views = []


for view in all_views:
	for group in all_groups:
		try:
			if prefix + (group.GroupType.LookupParameter('ФОП_Марка типа').AsValueString()) == view.Name:					
				group.GroupType.LookupParameter('ФОП_Изображение типа').Set( import_view (export_view (view), doc).Id)		
				selected_views.append(view.Name)
		except:
			if prefix + (group.GroupType.LookupParameter('ФОП_Марка Типа').AsValueString()) == view.Name:							
				group.GroupType.LookupParameter('ФОП_Изображение типа').Set( import_view (export_view (view), doc).Id)			
				selected_views.append(view)



OUT = all_groups

TransactionManager.Instance.TransactionTaskDone()
# ----------------------------------------

# group: Для разработчика
python_script = Python()  # IronPython2; frozen
# ---------- python_script.python (13 lines) ----------
import codecs
import os.path

path = r"W:\Проектный институт\Отд.стандарт.BIM и RD\BIM-Ресурсы\4-Dynamo\Архив\BIM-отдел\Dynamo_new_report.py"

result = ""

if os.path.exists(path):
	with codecs.open(path, 'r', encoding="utf-8") as file:
		for line in file.readlines():
			result += line

OUT = result
# ----------------------------------------
python_script_from_string = PythonStringNode(script=python_script)  # IronPython2
