# Dynamo graph script.dyn "Витражи - №3_Маркировка" (Dynamo 2.12.1.8246)

# group: ОПИСАНИЕ! ПРОЧИТАТЬ ПЕРЕД ЗАПУСКОМ!
# note: Скрипт "Витражи - №3_Маркировка"
# Версия 2.1
# Разработал: Козлов Павел
# ЧТО ДЕЛАЕТ:
# Маркирует группы по возрастанию площади
# КАК ПОЛЬЗОВАТЬСЯ:
# 1. Выбрать группу(ы) витража в модели или в спецификации
# 2. Запустить скрипт

# group: ИСХОДНЫЕ ДАННЫЕ
# note: Префикс для маркировки
префикс_маркировки = StringInput("ВНХ-")  # graph input
начать_нумерацию_с_номера = StringInput("1")  # graph input
перезапуск = BoolSelector(false)

суффикс_маркировки = StringInput("")  # graph input
маркировка = Python(IN[0]=префикс_маркировки, IN[1]=начать_нумерацию_с_номера, IN[2]=суффикс_маркировки, IN[3]=перезапуск)  # IronPython2
# ---------- маркировка.python (205 lines) ----------
import clr
clr.AddReference('ProtoGeometry')
clr.AddReference("System.Windows.Forms")
from Autodesk.DesignScript.Geometry import *
clr.AddReference("RevitServices")
import RevitServices
from RevitServices.Persistence import DocumentManager
from RevitServices.Transactions import TransactionManager
clr.AddReference("RevitAPI")
import Autodesk
from Autodesk.Revit.DB import *
from System.Collections.Generic import *
from operator import itemgetter
clr.AddReference("RevitNodes")
import Revit
clr.ImportExtensions(Revit.Elements)
import itertools
from itertools import groupby
import os
import System
from datetime import datetime
from System.Windows.Forms import MessageBox
import math


def location_up (element):
	
	point_down = element.Location.Point.Z * 304.8
	hieght = element.LookupParameter('ФОП_РАЗМ_Высота проёма').AsDouble() * 304.8
	point_up = point_down + hieght	
	
	return round(point_up)
	
	
# Функция, которая из всех выделенных групп, берет по одной
def group_instance (list_id):
	
	all_elements = []	
	for id in list_id:	
		noname_element = doc.GetElement(id)		
		if "Группы модели" == noname_element.Category.Name:		
			all_elements.append(noname_element)
		
	groups = {}		
	for group in all_elements:
		groupby_value = group.Name
					
		if groupby_value in groups:
			groups[groupby_value].append(group)				
		else:
			groups[groupby_value] = [group]	
	
	elements = []	
	for element in groups.Values:
		elements.append(element[0])
	
	return elements
	
	
# Функция, которая возвращает членов группы
def group_members (group):

	gr_members_ids = group.GetMemberIds()	
		
	list_of_members = []
	for id in gr_members_ids:		
		member = doc.GetElement(id)
		list_of_members.append(member)

	return list_of_members 
	
	
def get_area (group):
	
	main_members = []			
	for gr_member in group_members (group):
		if "Окн_Вит_Витраж" == gr_member.Name:
			main_members.append(gr_member)	
	
	groups = {}
	for element in main_members:		
		
		if str(location_up (element)) in groups:
			groups[str(location_up (element))].append(element)				
		else:
			groups[str(location_up (element))] = [element]
			
	list_mains_mont = []	
	list_corners_mont = []	
	list_height_mont = []	
	# Цикл по сгруппированным модулям по каждой высоте	
	for items in groups.items():				
		
		height_mont = []		
		mains_width_mont = []		
		left_corners_width_mont = []	
		right_corners_width_mont = []				
		# Цикл внутри каждой высоты	
		for item in items[1]:
			
			if 0 == item.LookupParameter('Левый_Угловой').AsInteger() and 0 == item.LookupParameter('Правый_Угловой').AsInteger():							
				mains_width_mont.append(item.LookupParameter('ФОП_РАЗМ_Ширина проёма').AsDouble() * 304.8)				
				height_mont.append(item.LookupParameter('ФОП_РАЗМ_Высота проёма').AsDouble() * 304.8)				
				
			elif 1 == item.LookupParameter('Левый_Угловой').AsInteger():	
				left_corners_width_mont.append(item.LookupParameter('ФОП_РАЗМ_Ширина проёма').AsDouble() * 304.8)
				height_mont.append(item.LookupParameter('ФОП_РАЗМ_Высота проёма').AsDouble() * 304.8)				
				
			elif 1 == item.LookupParameter('Правый_Угловой').AsInteger():
				right_corners_width_mont.append(item.LookupParameter('ФОП_РАЗМ_Ширина проёма').AsDouble() * 304.8)				
				height_mont.append(item.LookupParameter('ФОП_РАЗМ_Высота проёма').AsDouble() * 304.8)	
		
		sum_width_main_mont = sum(mains_width_mont)		
		
		sum_width_left_corners_mont = sum(left_corners_width_mont)		
		sum_width_right_corners_mont = sum(right_corners_width_mont)
		
		list_mains_mont.append(sum_width_main_mont)		
		list_corners_mont.append(sum_width_left_corners_mont)
		list_corners_mont.append(sum_width_right_corners_mont)		
			
		list_height_mont.append(max(height_mont))		
	
	max_mains_mont = max(list_mains_mont)	
	max_corners_mont = max(list_corners_mont)	
	sum_height_mont = sum(list_height_mont)	
	
	if round(max_corners_mont) == 0:
		corners_mont = ''
	else:
		corners_mont = 'x' + str(int(round(max_corners_mont)))	
		
	mains_mont = str(int(round(max_mains_mont)))
	height_mont = 'x' + str(int(round(sum_height_mont))) + '(h)'	
	
	gabarit_mont = mains_mont + height_mont + corners_mont		
	
	list_gab = gabarit_mont.Split('x')
	
	list_int_gab = []
	for gab in list_gab:
		list_int_gab.append(float(gab.Replace('(h)','')))
	
	if len (list_int_gab) == 2:
		area = (list_int_gab[0] / 1000) * (list_int_gab[1] / 1000)
	else:
		area = ((list_int_gab[0] / 1000) * (list_int_gab[1] / 1000)) + ((list_int_gab[1] / 1000) * (list_int_gab[2] / 1000))
	
	return area


# функция маркировки элементов
def numeration (list, prefix, suffix):
	
	for count, element in enumerate (list):			
		
		num = count + start	
		name = prefix + str(num) + suffix
		
		try:
			element[0].LookupParameter('ФОП_Марка типа').Set(name)			
		except:
			element[0].LookupParameter('ФОП_Марка Типа').Set(name)
			

# --------------------------------------------------------------------------------------------

doc = DocumentManager.Instance.CurrentDBDocument
uiapp = DocumentManager.Instance.CurrentUIApplication
app = uiapp.Application
uidoc = DocumentManager.Instance.CurrentUIApplication.ActiveUIDocument

# Префикс для маркировки 
prefix = IN[0]
# число, с которого начинаем маркировку
start = int(IN[1])
# Суффикс для маркировки 
suffix = IN[2]


# --------------------------------------------------------------------------------------------

# Выбераем элементы в модели
selected_ids = uidoc.Selection.GetElementIds()

# Отделяем только по одному экземпляру из всех выделенных групп
all_groups = group_instance (selected_ids)


TransactionManager.Instance.EnsureInTransaction(doc)

list_groups = []
for gro in all_groups:
	type = doc.GetElement(gro.GetTypeId())	
	list_groups.append([type, get_area (gro)])
	

sorted_list_group = sorted(list_groups, key = itemgetter(1))

numeration (sorted_list_group, prefix, suffix)


OUT = sorted_list_group

TransactionManager.Instance.TransactionTaskDone()
# ----------------------------------------

# group: Для разработчика
python_script = Python()  # IronPython2; frozen
# ---------- python_script.python (13 lines) ----------
import codecs
import os.path

path = r"W:\Проектный институт\Отд.стандарт.BIM и RD\BIM-Ресурсы\4-Dynamo\Архив\BIM-отдел\Dynamo_new_report.py"

result = ""

if os.path.exists(path):
	with codecs.open(path, 'r', encoding="utf-8") as file:
		for line in file.readlines():
			result += line

OUT = result
# ----------------------------------------
python_script_from_string = PythonStringNode(script=python_script)  # IronPython2
