# Dynamo graph script.dyn "Витражи - №0_3_Обновить габариты и позицию проема" (Dynamo 2.12.1.8246)

# group: ОПИСАНИЕ! ПРОЧИТАТЬ ПЕРЕД ЗАПУСКОМ!
# note: Скрипт "Витражи - №0_3_Обновить габариты и позицию проема"
# Версия 2.1
# Разработал: Козлов Павел
# ЧТО ДЕЛАЕТ:
# Актуализирует габариты проема, а также смещает на нужное место в случае изменения витража
# КАК ПОЛЬЗОВАТЬСЯ:
# 1. Выбрать 1 группу витража в модели и проем
# 2. Запустить скрипт

# group: Для разработчика
python_script = Python()  # IronPython2; frozen
# ---------- python_script.python (13 lines) ----------
import codecs
import os.path

path = r"W:\Проектный институт\Отд.стандарт.BIM и RD\BIM-Ресурсы\4-Dynamo\Архив\BIM-отдел\Dynamo_new_report.py"

result = ""

if os.path.exists(path):
	with codecs.open(path, 'r', encoding="utf-8") as file:
		for line in file.readlines():
			result += line

OUT = result
# ----------------------------------------
python_script_from_string = PythonStringNode(script=python_script)  # IronPython2

перезапуск = BoolSelector(true)
обновить_проем = Python(IN[0]=перезапуск)  # IronPython2
# ---------- обновить_проем.python (222 lines) ----------
import clr
clr.AddReference('ProtoGeometry')
clr.AddReference("System.Windows.Forms")
from Autodesk.DesignScript.Geometry import *
clr.AddReference("RevitServices")
import RevitServices
from RevitServices.Persistence import DocumentManager
from RevitServices.Transactions import TransactionManager
clr.AddReference("RevitAPI")
import Autodesk
from Autodesk.Revit.DB import *
from System.Collections.Generic import *
from operator import itemgetter
clr.AddReference("RevitNodes")
import Revit
clr.ImportExtensions(Revit.Elements)
import itertools
from itertools import groupby
import os
import System



# Функция, которая возвращает членов группы
def group_members (group):

	gr_members_ids = group.GetMemberIds()	
		
	list_of_members = []
	for id in gr_members_ids:		
		member = doc.GetElement(id)
		list_of_members.append(member)

	return list_of_members 


def location_up (element):
	
	point_down = element.Location.Point.Z
	hieght = element.LookupParameter('ФОП_РАЗМ_Высота проёма').AsDouble()
	point_up = point_down + hieght	
	
	return round(point_up)


# Функция, которая возвращает размеры группы
def dimensions (ells, condition):
	
	if condition == 0:
		list_members = group_members (ells)
	else:
		list_members = ells
	
	main_members = []			
	for gr_member in list_members:
		if "Окн_Вит_Витраж" == gr_member.Name:
			main_members.append(gr_member)	
	
	groups = {}
	for element in main_members:
	
		if str(location_up (element)) in groups:
			groups[str(location_up (element))].append(element)				
		else:
			groups[str(location_up (element))] = [element]		
	
	list_mains_mont = []	
	list_height_mont = []	
	# Цикл по сгруппированным модулям по каждой высоте	
	for items in groups.items():				
			
		height_mont = []		
		mains_width_mont = []		
		# Цикл внутри каждой высоты	
		for item in items[1]:
			if condition == 0:
				if 0 == item.LookupParameter('Левый_Угловой').AsInteger() and 0 == item.LookupParameter('Правый_Угловой').AsInteger():									
					mains_width_mont.append(item.LookupParameter('ФОП_РАЗМ_Ширина проёма').AsDouble())				
					height_mont.append(item.LookupParameter('ФОП_РАЗМ_Высота проёма').AsDouble())								
			else:
				mains_width_mont.append(item.LookupParameter('ФОП_РАЗМ_Ширина проёма').AsDouble())				
				height_mont.append(item.LookupParameter('ФОП_РАЗМ_Высота проёма').AsDouble())
				
		sum_width_main_mont = sum(mains_width_mont)		
		list_mains_mont.append(sum_width_main_mont)				
		list_height_mont.append(max(height_mont))
	
	mains_mont = max(list_mains_mont)	
	height_mont = sum(list_height_mont)	
	
	return height_mont, mains_mont
	

	
	
def xyz_group (ells, condition):	
	
	if condition == 0:
		list_mems = group_members (ells)
	else:
		list_mems = ells
		
	main_members = []			
	for gr_member in list_mems:
		if "Окн_Вит_Витраж" == gr_member.Name:
			main_members.append(gr_member)

	groups = {}
	for element in main_members:
	
		if str(location_up (element)) in groups:
			groups[str(location_up (element))].append(element)				
		else:
			groups[str(location_up (element))] = [element]
			
	max_z_list = []
	for each in groups.items()[0][1]:	
		h = each.LookupParameter('ФОП_РАЗМ_Высота проёма').AsDouble()		
		max_z_list.append([h, each])
	
	max_z = max(max_z_list)
	ground_z = max_z[1].Location.Point.Z - max_z[1].LookupParameter('Монтажный_Зазор_Снизу').AsDouble()
	
	min_x_list = []
	min_y_list = []	
	max_x_list = []	
	max_y_list = []
	
	for main_member in main_members:
		if condition == 0:
			if 0 == main_member.LookupParameter('Левый_Угловой').AsInteger() and 0 == main_member.LookupParameter('Правый_Угловой').AsInteger():				
				min_x_list.append(main_member.get_BoundingBox(doc.ActiveView).Min.X)
				min_y_list.append(main_member.get_BoundingBox(doc.ActiveView).Min.Y)			
				max_x_list.append(main_member.get_BoundingBox(doc.ActiveView).Max.X)
				max_y_list.append(main_member.get_BoundingBox(doc.ActiveView).Max.Y)						
		else:
			min_x_list.append(main_member.get_BoundingBox(doc.ActiveView).Min.X)
			min_y_list.append(main_member.get_BoundingBox(doc.ActiveView).Min.Y)			
			max_x_list.append(main_member.get_BoundingBox(doc.ActiveView).Max.X)
			max_y_list.append(main_member.get_BoundingBox(doc.ActiveView).Max.Y)
			
	mid_x = min(min_x_list) + ((max(max_x_list) - min(min_x_list)) / 2)
	mid_y = min(min_y_list) + ((max(max_y_list) - min(min_y_list)) / 2)
	xyz_point = XYZ(mid_x, mid_y, ground_z)	
	
	return  xyz_point


# Функция, по мусору
def garbage (list_id):	
	
	elements = []
	proem = []	
	for id in list_id:	
		noname_element = doc.GetElement(id)		
		
		if "Окна" == noname_element.Category.Name and "Окн_Вит_Проем" == noname_element.Name:
			proem.append(noname_element)
		elif "Группы модели" == noname_element.Category.Name or "Окна" == noname_element.Category.Name:		
			elements.append(noname_element)
	
	if "Группы модели" == elements[0].Category.Name:
		return elements[0], proem[0]
	
	else:
		return elements, proem[0]

# --------------------------------------------------------------------------------------------			
# --------------------------------------------------------------------------------------------
# Переменные
# --------------------------------------------------------------------------------------------			
# --------------------------------------------------------------------------------------------


doc = DocumentManager.Instance.CurrentDBDocument
uiapp = DocumentManager.Instance.CurrentUIApplication
app = uiapp.Application
uidoc = DocumentManager.Instance.CurrentUIApplication.ActiveUIDocument


# --------------------------------------------------------------------------------------------			
# --------------------------------------------------------------------------------------------
# Транзакция
# --------------------------------------------------------------------------------------------			
# --------------------------------------------------------------------------------------------


TransactionManager.Instance.EnsureInTransaction(doc)


# Выбераем элементы в модели
selected_ids = uidoc.Selection.GetElementIds()


element_sel = garbage (selected_ids)[0]
proem_sel = garbage (selected_ids)[1]


if element_sel.GetType() == list:	
	dim_height = dimensions (element_sel, 1)[0]
	dim_weight = dimensions (element_sel, 1)[1]
	coordinate = xyz_group (element_sel, 1)
else:	
	dim_height = dimensions (element_sel, 0)[0]
	dim_weight = dimensions (element_sel, 0)[1]
	coordinate = xyz_group (element_sel, 0)

new_x = coordinate.X - proem_sel.Location.Point.X
new_y = coordinate.Y - proem_sel.Location.Point.Y
new_z = coordinate.Z - proem_sel.Location.Point.Z


new_xyz = XYZ(new_x, new_y, new_z )

proem_sel.Location.Move(new_xyz)
proem_sel.LookupParameter('Высота').Set(dim_height)
proem_sel.LookupParameter('Ширина').Set(dim_weight)


OUT = new_xyz

TransactionManager.Instance.TransactionTaskDone()
# ----------------------------------------
