# Dynamo graph script.dyn "Витражи - №2_Описание" (Dynamo 2.12.1.8246)

# group: ОПИСАНИЕ! ПРОЧИТАТЬ ПЕРЕД ЗАПУСКОМ!
# note: Скрипт "Витражи - №2_Описание"
# Версия 2.1
# Разработал: Козлов Павел
# ЧТО ДЕЛАЕТ:
# Заполняет описание группы витражей
# КАК ПОЛЬЗОВАТЬСЯ:
# 1. Выбрать группу(ы) витража в модели или в спецификации
# 2. Запустить скрипт

перезапуск = BoolSelector(true)
дописать_любой_текст_в_описание = StringInput("Цвет профиля RAL7024 (матовый).")  # graph input
заполнение_описания = Python(IN[0]=перезапуск, IN[1]=дописать_любой_текст_в_описание)  # IronPython2
# ---------- заполнение_описания.python (312 lines) ----------
import clr
clr.AddReference('ProtoGeometry')
clr.AddReference("System.Windows.Forms")
from Autodesk.DesignScript.Geometry import *
clr.AddReference("RevitServices")
import RevitServices
from RevitServices.Persistence import DocumentManager
from RevitServices.Transactions import TransactionManager
clr.AddReference("RevitAPI")
import Autodesk
from Autodesk.Revit.DB import *
from System.Collections.Generic import *
from operator import itemgetter
clr.AddReference("RevitNodes")
import Revit
clr.ImportExtensions(Revit.Elements)
import itertools
from itertools import groupby
import os
import System
from datetime import datetime
from System.Windows.Forms import MessageBox
import math


# Функция, которая из всех выделенных групп, берет по одной
def group_instance (list_id):
	
	all_elements = []	
	for id in list_id:	
		noname_element = doc.GetElement(id)		
		if "Группы модели" == noname_element.Category.Name:		
			all_elements.append(noname_element)
		
	groups = {}		
	for group in all_elements:
		groupby_value = group.Name
					
		if groupby_value in groups:
			groups[groupby_value].append(group)				
		else:
			groups[groupby_value] = [group]	
	
	elements = []	
	for element in groups.Values:
		elements.append(element[0])
	
	return elements
	

# Функция, которая возвращает членов группы
def group_members (group):

	gr_members_ids = group.GetMemberIds()	
		
	list_of_members = []
	for id in gr_members_ids:		
		member = doc.GetElement(id)
		list_of_members.append(member)

	return list_of_members 
	
	
def  in_out (element):
	if 1 == element.LookupParameter('Наружный').AsInteger():
		return 'Наружный витраж'
	else:
		return 'Внутренний витраж'


def  warm_cold (element):
	if 1 == element.LookupParameter('Холодный').AsInteger():
		return  ' из "холодного"'
	else:
		return ' из "тёплого"'


def  profile (element):
	if 0 == element.LookupParameter('Профиль').AsInteger():
		return  ' алюминиевого профиля'
	else:
		return ' ПВХ-профиля'


def glass (element):

	if 0 == element.LookupParameter('Остекление').AsInteger():			
		return ' c одинарным остеклением.'		
	elif 1 == element.LookupParameter('Остекление').AsInteger():
		return ' c однокамерным стеклопакетом.'
	elif 2 == element.LookupParameter('Остекление').AsInteger():
		return ' c двухкамерным стеклопакетом.'
	elif 3 == element.LookupParameter('Остекление').AsInteger(): 
		return ' c трехкамерным стеклопакетом.'
	else:
		return ' c двухкамерным стеклопакетом.'


def ograjdenie (list):

	if sum(list) > 0:
		return ' Встроенное перильное ограждение, шаг 0,11м.'
	else:
		return ''


def comparison_mat (name):
	if 'решетка' in name.lower():
		return ' Решетка в составе витража (c внутренней стороны закрыть временной сэндвич панелью).'
	elif 'тонированн' in name.lower():
		return ' Вставки из тонированного стекла.'
	elif 'закаленн' in name.lower():
		return ' Вставки из закалённого стекла.'		
	elif 'сэндвич' in name.lower():
		return ' Вставки из сэндвич панелей.'
	else: 
		return ''



def parsing_mats (element):

	list = []
	
	if 'Окн_Вит_Ячейка_1х1' == element.Symbol.Family.Name:
		list.append (comparison_mat (element.Symbol.LookupParameter('Заполнение_Материал').AsValueString()))	
		
	elif 'Окн_Вит_Ячейка_1х2' == element.Symbol.Family.Name:
		list.append (comparison_mat (element.Symbol.LookupParameter('Заполнение_Материал_Левая_Створка').AsValueString()))
		list.append (comparison_mat (element.Symbol.LookupParameter('Заполнение_Материал_Правая_Створка').AsValueString()))
		
	elif 'Окн_Вит_Ячейка_1х3' == element.Symbol.Family.Name:
		list.append (comparison_mat (element.Symbol.LookupParameter('Заполнение_Материал_Левая_Створка').AsValueString()))
		list.append (comparison_mat (element.Symbol.LookupParameter('Заполнение_Материал_Центр_Створка').AsValueString()))
		list.append (comparison_mat (element.Symbol.LookupParameter('Заполнение_Материал_Правая_Створка').AsValueString()))
		
	elif 'Окн_Вит_Ячейка_Дверь' == element.Symbol.Family.Name:
		list.append (comparison_mat (element.Symbol.LookupParameter('Заполнение_Материал').AsValueString()))
		if 1 == element.Symbol.LookupParameter('Домофонная_Панель_Справа').AsInteger() or 1 == element.Symbol.LookupParameter('Домофонная_Панель_Слева').AsInteger():
			list.append (comparison_mat (element.Symbol.LookupParameter('Заполнение_Материал_Домофонная_Панель').AsValueString()))
		
	return list
	

def open(element, par):
	return element.Symbol.LookupParameter(par).AsInteger()
	

def parsing_cell (element):

	list = []
	
	if 'Окн_Вит_Ячейка_1х1' == element.Symbol.Family.Name:
		if 1 == open(element, 'Код_Открывания') or 2 == open(element, 'Код_Открывания'):
			list.append (' Поворотная створка.')
		elif 2 == open(element, 'Код_Открывания') or 3 == open(element, 'Код_Открывания'):
			list.append (' Поворотнo-откидная створка.')
		elif 5 == open(element, 'Код_Открывания') or 6 == open(element, 'Код_Открывания'):
			list.append (' Откидная створка.')
		elif 7 == open(element, 'Код_Открывания'):
			list.append (' Сдвижная створка.')
			
	if 'Окн_Вит_Ячейка_1х2' == element.Symbol.Family.Name:
		if 1 == open(element, 'Код_Открывания_Левая_Створка') or 2 == open(element, 'Код_Открывания_Левая_Створка'):
			list.append (' Поворотная створка.')
		elif 1 == open(element, 'Код_Открывания_Правая_Створка') or 2 == open(element, 'Код_Открывания_Правая_Створка'):
			list.append (' Поворотная створка.')	
			
		elif 3 == open(element, 'Код_Открывания_Левая_Створка') or 4 == open(element, 'Код_Открывания_Левая_Створка'):
			list.append (' Поворотнo-откидная створка.')
		elif 3 == open(element, 'Код_Открывания_Правая_Створка') or 4 == open(element, 'Код_Открывания_Правая_Створка'):
			list.append (' Поворотнo-откидная створка.')
			
		elif 5 == open(element, 'Код_Открывания_Левая_Створка') or 6 == open(element, 'Код_Открывания_Левая_Створка'):
			list.append (' Откидная створка.')
		elif 5 == open(element, 'Код_Открывания_Правая_Створка') or 6 == open(element, 'Код_Открывания_Правая_Створка'):
			list.append (' Откидная створка.')
			
		elif 7 == open(element, 'Код_Открывания_Левая_Створка'):
			list.append (' Сдвижная створка.')
		elif 7 == open(element, 'Код_Открывания_Правая_Створка'):
			list.append (' Сдвижная створка.')
			
		elif 8 == open(element, 'Код_Открывания_Левая_Створка'):
			list.append (' Окно выдачи.')
		elif 8 == open(element, 'Код_Открывания_Правая_Створка'):
			list.append (' Окно выдачи.')
		
		
	if 'Окн_Вит_Ячейка_1х3' == element.Symbol.Family.Name:
		if 1 == open(element, 'Код_Открывания_Левая_Створка') or 2 == open(element, 'Код_Открывания_Левая_Створка'):
			list.append (' Поворотная створка.')
		elif 1 == open(element, 'Код_Открывания_Центр_Створка') or 2 == open(element, 'Код_Открывания_Правая_Створка'):
			list.append (' Поворотная створка.')
		elif 1 == open(element, 'Код_Открывания_Правая_Створка') or 2 == open(element, 'Код_Открывания_Правая_Створка'):
			list.append (' Поворотная створка.')	
			
		elif 3 == open(element, 'Код_Открывания_Левая_Створка') or 4 == open(element, 'Код_Открывания_Левая_Створка'):
			list.append (' Поворотнo-откидная створка.')
		elif 3 == open(element, 'Код_Открывания_Центр_Створка') or 4 == open(element, 'Код_Открывания_Правая_Створка'):
			list.append (' Поворотная створка.')
		elif 3 == open(element, 'Код_Открывания_Правая_Створка') or 4 == open(element, 'Код_Открывания_Правая_Створка'):
			list.append (' Поворотнo-откидная створка.')
			
		elif 5 == open(element, 'Код_Открывания_Левая_Створка') or 6 == open(element, 'Код_Открывания_Левая_Створка'):
			list.append (' Откидная створка.')
		elif 5 == open(element, 'Код_Открывания_Центр_Створка') or 6 == open(element, 'Код_Открывания_Правая_Створка'):
			list.append (' Поворотная створка.')
		elif 5 == open(element, 'Код_Открывания_Правая_Створка') or 6 == open(element, 'Код_Открывания_Правая_Створка'):
			list.append (' Откидная створка.')
			
		elif 7 == open(element, 'Код_Открывания_Левая_Створка'):
			list.append (' Сдвижная створка.')
		elif 7 == open(element, 'Код_Открывания_Центр_Створка'):
			list.append (' Сдвижная створка.')
		elif 7 == open(element, 'Код_Открывания_Правая_Створка'):
			list.append (' Сдвижная створка.')			
		
		
	if 'Окн_Вит_Ячейка_Дверь' == element.Symbol.Family.Name:
		if 0 == open(element, 'Код_Открывания') or 1 == open(element, 'Код_Открывания'):
			list.append (' Одностворчатая дверь.')
		elif 2 == open(element, 'Код_Открывания') or 3 == open(element, 'Код_Открывания') or 4 == open(element, 'Код_Открывания'):
			list.append (' Двустворчатая дверь (одна из створок не менее 900мм).')
		
		
		if 1 == open(element, 'Домофонная_Панель_Слева') or 1 == open(element, 'Домофонная_Панель_Справа'):	
			list.append (' Домофонная панель.')
		
			
	
	return list

# Функция, которая возвращает описание состава группы
def description (group):
	
	members = []
	main_members = []
	
	for gr_member in group_members (group):
		if "Окн_Вит_Витраж" != gr_member.Name:
			members.append(gr_member)	
		elif "Окн_Вит_Витраж" == gr_member.Name:
			main_members.append(gr_member)
		
		if "ОбщМд_Козырек_Стеклянный" == gr_member.Name:
			visor = ' Козырек.'
		else:
			visor = ''
	
	# Начало описание по любому модулю
	main_code = in_out (main_members[0]) + warm_cold (main_members[0]) + profile (main_members[0]) + glass (main_members[0])
	
	# Описание ячеек и матеоиалов
	mats = []
	cells = []
	for member in members:
		mats.append(parsing_mats (member))		
		cells.append(parsing_cell (member))
		
	clean_mats = set(list(itertools.chain(*mats)))
	clean_cells = set(list(itertools.chain(*cells)))	
		
	if len(clean_cells) == 0:
		cells_code = ' Глухой.'
	else:	
		cells_code = ''.join(clean_cells)
		
	mats_code = ''.join(clean_mats)	

	# Описание ограждения
	ogr_list = []
	for main in main_members:		
		if int(main.LookupParameter('Ограждение_Высота').AsValueString()) > 0: 
			ogr_list.append(1)
	
	ogr_code = ograjdenie (ogr_list)
	
	
	
	
	
	return  main_code + cells_code + mats_code + ogr_code + visor + ' ' + add_text

		
# --------------------------------------------------------------------------------------------

doc = DocumentManager.Instance.CurrentDBDocument
uiapp = DocumentManager.Instance.CurrentUIApplication
app = uiapp.Application
uidoc = DocumentManager.Instance.CurrentUIApplication.ActiveUIDocument

add_text = IN[1]

# --------------------------------------------------------------------------------------------

# Выбераем элементы в модели
selected_ids = uidoc.Selection.GetElementIds()

# Отделяем только по одному экземпляру из всех выделенных групп
all_groups = group_instance (selected_ids)


TransactionManager.Instance.EnsureInTransaction(doc)

for gro in all_groups:
	type = doc.GetElement(gro.GetTypeId())
	type.LookupParameter('ФОП_Описание типа').Set(description (gro))
	


TransactionManager.Instance.TransactionTaskDone()
# ----------------------------------------

# group: Для разработчика
python_script = Python()  # IronPython2; frozen
# ---------- python_script.python (13 lines) ----------
import codecs
import os.path

path = r"W:\Проектный институт\Отд.стандарт.BIM и RD\BIM-Ресурсы\4-Dynamo\Архив\BIM-отдел\Dynamo_new_report.py"

result = ""

if os.path.exists(path):
	with codecs.open(path, 'r', encoding="utf-8") as file:
		for line in file.readlines():
			result += line

OUT = result
# ----------------------------------------
python_script_from_string = PythonStringNode(script=python_script)  # IronPython2
