# Dynamo graph script.dyn (Dynamo 2.10.1.3976)

# group: ОПИСАНИЕ! ПРОЧИТАТЬ ПЕРЕД ЗАПУСКОМ!
# note: Скрипт "Витражи - №4_Сквозная маркировка"
# Версия 2.1
# Разработал: Козлов Павел
# ЧТО ДЕЛАЕТ:
# Маркирует группы по заранее подготовленному EXCELL - файлу
# КАК ПОЛЬЗОВАТЬСЯ:
# 1. Выбрать группу(ы) витража в модели или в спецификации
# 2. Выбрать заранее подготовленный EXCELL - файл
# 3. Запустить скрипт

# group: ИСХОДНЫЕ ДАННЫЕ
# note: Выбрать заранее подготовленный и пронумерованный файл
выбор_excel_файла = Python()  # IronPython2
# ---------- выбор_excel_файла.python (39 lines) ----------
import clr
clr.AddReference('ProtoGeometry')
clr.AddReference("System.Windows.Forms")
from Autodesk.DesignScript.Geometry import *
clr.AddReference("RevitServices")
import RevitServices
from RevitServices.Persistence import DocumentManager
from RevitServices.Transactions import TransactionManager
clr.AddReference("RevitAPI")
import Autodesk
from Autodesk.Revit.DB import *
doc = DocumentManager.Instance.CurrentDBDocument
uiapp = DocumentManager.Instance.CurrentUIApplication
app = uiapp.Application
from System.Collections.Generic import *
uidoc = DocumentManager.Instance.CurrentUIApplication.ActiveUIDocument
from operator import itemgetter
clr.AddReference("RevitNodes")
import Revit
clr.ImportExtensions(Revit.Elements)
import itertools
from itertools import groupby
import os
import System
from System.Windows.Forms import SaveFileDialog, OpenFileDialog, DialogResult


openFileDialog = OpenFileDialog()

openFileDialog.Title = "Выберите Excel-файл"
openFileDialog.InitialDirectory = "c:\\"
openFileDialog.Filter = "Excel Files|*.xls;*.xlsx;*.xlsm"
openFileDialog.FilterIndex = 1
openFileDialog.RestoreDirectory = True

if openFileDialog.ShowDialog() == DialogResult.OK:
	filePath = openFileDialog.FileName

OUT = filePath
# ----------------------------------------

сквозная_маркировка = Python(IN[0]=выбор_excel_файла)  # IronPython2
# ---------- сквозная_маркировка.python (112 lines) ----------
import clr
clr.AddReference('ProtoGeometry')
clr.AddReference("System.Windows.Forms")
from Autodesk.DesignScript.Geometry import *
clr.AddReference("RevitServices")
import RevitServices
from RevitServices.Persistence import DocumentManager
from RevitServices.Transactions import TransactionManager
clr.AddReference("RevitAPI")
import Autodesk
from Autodesk.Revit.DB import *
from System.Collections.Generic import *
from operator import itemgetter
clr.AddReference("RevitNodes")
import Revit
clr.ImportExtensions(Revit.Elements)
import itertools
from itertools import groupby
import os
import System
from System.Windows.Forms import SaveFileDialog, OpenFileDialog
clr.AddReference("Microsoft.Office.Interop.Excel")
import Microsoft.Office.Interop.Excel as Excel
from System.Runtime.InteropServices import Marshal



# Функция, которая из всех выделенных групп, берет по одной
def group_instance (list_id):
	
	all_elements = []	
	for id in list_id:	
		noname_element = doc.GetElement(id)		
		if "Группы модели" == noname_element.Category.Name:		
			all_elements.append(noname_element)
		
	groups = {}		
	for group in all_elements:
		groupby_value = group.Name
					
		if groupby_value in groups:
			groups[groupby_value].append(group)				
		else:
			groups[groupby_value] = [group]	
	
	elements = []	
	for element in groups.Values:
		elements.append(element[0])
	
	return elements
	

def read_from_excel(path):
    excel = Excel.ApplicationClass()
    excel.Visible = False
    excel.DisplayAlerts = False
    names = []
    try:
        workbook = excel.Workbooks.Open(path)
        ws = workbook.Worksheets(1)
        row_end = 200
        
        for i in range(2, row_end):
            if ws.Cells(i, 1).Text:
                names.append ([ws.Cells(i, 1).Text, ws.Cells(i, 2).Text])
            	
    finally:
        excel.ActiveWorkbook.Close(False)
        Marshal.ReleaseComObject(ws)
        Marshal.ReleaseComObject(workbook)
        Marshal.ReleaseComObject(excel)
    return names


def set_marks (list, excell_list):
	
	for data in excell_list: 
		for element in list:
			if data[1] == element.GroupType.LookupParameter('Имя типа').AsValueString():					
				try:
					element.GroupType.LookupParameter('ФОП_Марка типа').Set(data[0])
				except:
					element.GroupType.LookupParameter('ФОП_Марка Типа').Set(data[0])


# --------------------------------------------------------------------------------------------


doc = DocumentManager.Instance.CurrentDBDocument
uiapp = DocumentManager.Instance.CurrentUIApplication
app = uiapp.Application
uidoc = DocumentManager.Instance.CurrentUIApplication.ActiveUIDocument


PATH = IN[1]
EXCELL_DATA = read_from_excel (PATH)


# Выбераем элементы в модели
selected_ids = uidoc.Selection.GetElementIds()

# Отделяем только по одному экземпляру из всех выделенных групп
all_groups = group_instance (selected_ids)

		
TransactionManager.Instance.EnsureInTransaction(doc)

	
set_marks (all_groups, EXCELL_DATA)


TransactionManager.Instance.TransactionTaskDone()
# ----------------------------------------

# group: Для разработчика
python_script = Python()  # IronPython2; frozen
# ---------- python_script.python (13 lines) ----------
import codecs
import os.path

path = r"W:\Проектный институт\Отд.стандарт.BIM и RD\BIM-Ресурсы\4-Dynamo\Архив\BIM-отдел\Dynamo_new_report.py"

result = ""

if os.path.exists(path):
	with codecs.open(path, 'r', encoding="utf-8") as file:
		for line in file.readlines():
			result += line

OUT = result
# ----------------------------------------
python_script_from_string = PythonStringNode(script=python_script)  # IronPython2
