# Dynamo graph script.dyn "Витражи - №0_1_Собрать группу" (Dynamo 2.12.1.8246)

# group: ОПИСАНИЕ! ПРОЧИТАТЬ ПЕРЕД ЗАПУСКОМ!
# note: Скрипт "Витражи - №0_1_Собрать группу"
# Версия 2.1
# Разработал: Козлов Павел
# ЧТО ДЕЛАЕТ:
# Собирает группу по всем правилам и осуществляет проверку на всех уровнях
# КАК ПОЛЬЗОВАТЬСЯ:
# 1. Выбрать витражи
# 2. Запустить скрипт

перезапуск = BoolSelector(true)
собрать_группу = Python(IN[0]=перезапуск)  # IronPython2
# ---------- собрать_группу.python (517 lines) ----------
import clr
clr.AddReference('ProtoGeometry')
clr.AddReference("System.Windows.Forms")
clr.AddReference("PresentationCore")
from Autodesk.DesignScript.Geometry import *
clr.AddReference("RevitServices")
import RevitServices
from RevitServices.Persistence import DocumentManager
from RevitServices.Transactions import TransactionManager
clr.AddReference("RevitAPI")
import Autodesk
from Autodesk.Revit.DB import *
from System.Collections.Generic import *
from operator import itemgetter
clr.AddReference("RevitNodes")
import Revit
clr.ImportExtensions(Revit.Elements)
import itertools
from itertools import groupby
from itertools import chain
import os
import System
from datetime import datetime
from System.Windows.Forms import MessageBox
import math
from System.Windows import Clipboard


def location_up (element):
	
	point_down = element.Location.Point.Z * 304.8
	hieght = element.LookupParameter('ФОП_РАЗМ_Высота проёма').AsDouble() * 304.8
	point_up = point_down + hieght	
	
	return round(point_up)
	
	
# Функция, которая возвращает размеры группы
def dimensions (els_list):
	
	main_members = []			
	for gr_member in els_list:
		if "Окн_Вит_Витраж" == gr_member.Name:
			main_members.append(gr_member)	
	
	groups = {}
	for element in main_members:		
		
		if str(location_up (element)) in groups:
			groups[str(location_up (element))].append(element)				
		else:
			groups[str(location_up (element))] = [element]
			
	list_mains_mont = []	
	list_corners_mont = []	
	list_height_mont = []	
	# Цикл по сгруппированным модулям по каждой высоте	
	for items in groups.items():				
		
		height_mont = []		
		mains_width_mont = []		
		left_corners_width_mont = []	
		right_corners_width_mont = []				
		# Цикл внутри каждой высоты	
		for item in items[1]:
			
			if 0 == item.LookupParameter('Левый_Угловой').AsInteger() and 0 == item.LookupParameter('Правый_Угловой').AsInteger():							
				mains_width_mont.append(item.LookupParameter('ФОП_РАЗМ_Ширина проёма').AsDouble() * 304.8)				
				height_mont.append(item.LookupParameter('ФОП_РАЗМ_Высота проёма').AsDouble() * 304.8)				
				
			elif 1 == item.LookupParameter('Левый_Угловой').AsInteger():	
				left_corners_width_mont.append(item.LookupParameter('ФОП_РАЗМ_Ширина проёма').AsDouble() * 304.8)
				height_mont.append(item.LookupParameter('ФОП_РАЗМ_Высота проёма').AsDouble() * 304.8)				
				
			elif 1 == item.LookupParameter('Правый_Угловой').AsInteger():
				right_corners_width_mont.append(item.LookupParameter('ФОП_РАЗМ_Ширина проёма').AsDouble() * 304.8)				
				height_mont.append(item.LookupParameter('ФОП_РАЗМ_Высота проёма').AsDouble() * 304.8)	
		
		sum_width_main_mont = sum(mains_width_mont)		
		
		sum_width_left_corners_mont = sum(left_corners_width_mont)		
		sum_width_right_corners_mont = sum(right_corners_width_mont)
		
		list_mains_mont.append(sum_width_main_mont)		
		list_corners_mont.append(sum_width_left_corners_mont)
		list_corners_mont.append(sum_width_right_corners_mont)		
			
		list_height_mont.append(max(height_mont))		
	
	max_mains_mont = max(list_mains_mont)	
	max_corners_mont = max(list_corners_mont)	
	sum_height_mont = sum(list_height_mont)	
	
	if round(max_corners_mont) == 0:
		corners_mont = ''
	else:
		corners_mont = 'x' + str(int(round(max_corners_mont)))	
		
	mains_mont = str(int(round(max_mains_mont)))
	height_mont = 'x' + str(int(round(sum_height_mont))) + '(h)'	
	
	gabarit_mont = mains_mont + height_mont + corners_mont		
	
	return  '_' + gabarit_mont


def  in_out (element):
	if 1 == element.LookupParameter('Наружный').AsInteger():
		return 'ВН'
	else:
		return 'ВВ'


def  warm_cold (element):
	if 1 == element.LookupParameter('Холодный').AsInteger():
		return  'Х'
	else:
		return ''


def  profile (element):
	if 0 == element.LookupParameter('Профиль').AsInteger():
		return  '.АЛ'
	else:
		return '.ПВХ'


def glass (element):

	if 0 == element.LookupParameter('Остекление').AsInteger():			
		return '.1ост'		
	elif 1 == element.LookupParameter('Остекление').AsInteger():
		return '.1кст'
	elif 2 == element.LookupParameter('Остекление').AsInteger():
		return '.2кст'
	elif 3 == element.LookupParameter('Остекление').AsInteger(): 
		return '.2кст'
	else:
		return '.2кст'


def ograjdenie (list):

	if sum(list) > 0:
		return '.Огр'
	else:
		return ''


def comparison_mat (name):
	if 'решетка' in name.lower():
		return '.Реш'
	elif 'тонированн' in name.lower():
		return '.Тон'
	elif 'закаленн' in name.lower():
		return '.Зак'		
	elif 'эндвич' in name.lower():
		return '.СэндПан'
	else: 
		return ''



def parsing_mats (element):

	list = []
	
	if 'Окн_Вит_Ячейка_1х1' == element.Symbol.Family.Name:
		list.append (comparison_mat (element.Symbol.LookupParameter('Заполнение_Материал').AsValueString()))	
		
	elif 'Окн_Вит_Ячейка_1х2' == element.Symbol.Family.Name:
		list.append (comparison_mat (element.Symbol.LookupParameter('Заполнение_Материал_Левая_Створка').AsValueString()))
		list.append (comparison_mat (element.Symbol.LookupParameter('Заполнение_Материал_Правая_Створка').AsValueString()))
		
	elif 'Окн_Вит_Ячейка_1х3' == element.Symbol.Family.Name:
		list.append (comparison_mat (element.Symbol.LookupParameter('Заполнение_Материал_Левая_Створка').AsValueString()))
		list.append (comparison_mat (element.Symbol.LookupParameter('Заполнение_Материал_Центр_Створка').AsValueString()))
		list.append (comparison_mat (element.Symbol.LookupParameter('Заполнение_Материал_Правая_Створка').AsValueString()))
		
	elif 'Окн_Вит_Ячейка_Дверь' == element.Symbol.Family.Name:
		list.append (comparison_mat (element.Symbol.LookupParameter('Заполнение_Материал').AsValueString()))
		
		if 1 == element.Symbol.LookupParameter('Домофонная_Панель_Справа').AsInteger() or 1 == element.Symbol.LookupParameter('Домофонная_Панель_Слева').AsInteger():
			list.append (comparison_mat (element.Symbol.LookupParameter('Заполнение_Материал_Домофонная_Панель').AsValueString())) 
		
	return list
	

def open(element, par):
	return element.Symbol.LookupParameter(par).AsInteger()
	

def parsing_cell (element):

	list = []
	
	if 'Окн_Вит_Ячейка_1х1' == element.Symbol.Family.Name:
		if 1 == open(element, 'Код_Открывания') or 2 == open(element, 'Код_Открывания'):
			list.append ('.Пов')
		elif 3 == open(element, 'Код_Открывания') or 4 == open(element, 'Код_Открывания'):
			list.append ('.Пов-Отк')
		elif 5 == open(element, 'Код_Открывания') or 6 == open(element, 'Код_Открывания'):
			list.append ('.Отк')
		elif 7 == open(element, 'Код_Открывания'):
			list.append ('.Сдвиж')
			
	if 'Окн_Вит_Ячейка_1х2' == element.Symbol.Family.Name:
		if 1 == open(element, 'Код_Открывания_Левая_Створка') or 2 == open(element, 'Код_Открывания_Левая_Створка'):
			list.append ('.Пов')
		elif 1 == open(element, 'Код_Открывания_Правая_Створка') or 2 == open(element, 'Код_Открывания_Правая_Створка'):
			list.append ('.Пов')	
			
		elif 3 == open(element, 'Код_Открывания_Левая_Створка') or 4 == open(element, 'Код_Открывания_Левая_Створка'):
			list.append ('.Пов-Отк')
		elif 3 == open(element, 'Код_Открывания_Правая_Створка') or 4 == open(element, 'Код_Открывания_Правая_Створка'):
			list.append ('.Пов-Отк')
			
		elif 5 == open(element, 'Код_Открывания_Левая_Створка') or 6 == open(element, 'Код_Открывания_Левая_Створка'):
			list.append ('.Отк')
		elif 5 == open(element, 'Код_Открывания_Правая_Створка') or 6 == open(element, 'Код_Открывания_Правая_Створка'):
			list.append ('.Отк')
			
		elif 7 == open(element, 'Код_Открывания_Левая_Створка'):
			list.append ('.Сдвиж_х2')
		elif 7 == open(element, 'Код_Открывания_Правая_Створка'):
			list.append ('.Сдвиж_х2')
			
		elif 8 == open(element, 'Код_Открывания_Левая_Створка'):
			list.append ('.Окн-выд')
		elif 8 == open(element, 'Код_Открывания_Правая_Створка'):
			list.append ('.Окн-выд')
		
		
	if 'Окн_Вит_Ячейка_1х3' == element.Symbol.Family.Name:
		if 1 == open(element, 'Код_Открывания_Левая_Створка') or 2 == open(element, 'Код_Открывания_Левая_Створка'):
			list.append ('.Пов')
		elif 1 == open(element, 'Код_Открывания_Центр_Створка') or 2 == open(element, 'Код_Открывания_Правая_Створка'):
			list.append ('.Пов')
		elif 1 == open(element, 'Код_Открывания_Правая_Створка') or 2 == open(element, 'Код_Открывания_Правая_Створка'):
			list.append ('.Пов')	
			
		elif 3 == open(element, 'Код_Открывания_Левая_Створка') or 4 == open(element, 'Код_Открывания_Левая_Створка'):
			list.append ('.Пов-Отк')
		elif 3 == open(element, 'Код_Открывания_Центр_Створка') or 4 == open(element, 'Код_Открывания_Правая_Створка'):
			list.append ('.Пов-Отк')
		elif 3 == open(element, 'Код_Открывания_Правая_Створка') or 4 == open(element, 'Код_Открывания_Правая_Створка'):
			list.append ('.Пов-Отк')
			
		elif 5 == open(element, 'Код_Открывания_Левая_Створка') or 6 == open(element, 'Код_Открывания_Левая_Створка'):
			list.append ('.Отк')
		elif 5 == open(element, 'Код_Открывания_Центр_Створка') or 6 == open(element, 'Код_Открывания_Правая_Створка'):
			list.append ('.Отк')
		elif 5 == open(element, 'Код_Открывания_Правая_Створка') or 6 == open(element, 'Код_Открывания_Правая_Створка'):
			list.append ('.Отк')
			
		elif 7 == open(element, 'Код_Открывания_Левая_Створка'):
			list.append ('.Сдвиж_х3')
		elif 7 == open(element, 'Код_Открывания_Центр_Створка'):
			list.append ('.Сдвиж_х3')
		elif 7 == open(element, 'Код_Открывания_Правая_Створка'):
			list.append ('.Сдвиж_х3')			
		
		
	if 'Окн_Вит_Ячейка_Дверь' == element.Symbol.Family.Name:
		if 0 == open(element, 'Код_Открывания') or 1 == open(element, 'Код_Открывания'):
			list.append ('.1СтвДв')
		elif 2 == open(element, 'Код_Открывания') or 3 == open(element, 'Код_Открывания') or 4 == open(element, 'Код_Открывания'):
			list.append ('.2СтвДв')
		
		
		if 1 == open(element, 'Домофонная_Панель_Слева') or 1 == open(element, 'Домофонная_Панель_Справа'):	
			list.append ('.ДомПан')
		
				
	return list

# Функция, которая возвращает описание состава группы
def description (elem_list):
	visor = ''
	gru_members = []
	main_members = []	
	for gr_member in elem_list:
		if "Окн_Вит_Витраж" == gr_member.Name:
			main_members.append(gr_member)	
			
			memers_ids = gr_member.GetSubComponentIds()
			members_els = [doc.GetElement(id) for id in memers_ids]
			gru_members.append(members_els)			
		
		elif "ОбщМд_Козырек_Стеклянный" == gr_member.Name:
			visor = '.Козырек'
		else:
			visor = ''
			
	check_ug = []
	for mai in main_members:
		check_ug.append( mai.LookupParameter('Левый_Угловой').AsInteger()) 
		check_ug.append( mai.LookupParameter('Правый_Угловой').AsInteger())
	
	
	vit_config = '.Пл' if sum(check_ug) == 0 else '.Уг'	
		
	vit_len = '_' + str(len(main_members))	
	
	# Начало описание по любому модулю
	main_code = 'Витраж_' + in_out (main_members[0]) + warm_cold (main_members[0]) + vit_config + vit_len + profile (main_members[0]) +  glass (main_members[0])	

	members = list(chain(*gru_members))
	
	# Описание ячеек и матеоиалов
	mats = []
	cells = []
	for member in members:
		mats.append(parsing_mats (member))		
		cells.append(parsing_cell (member))
		
	clean_mats = set(list(itertools.chain(*mats)))
	clean_cells = set(list(itertools.chain(*cells)))	
		
	if len(clean_cells) == 0:
		cells_code = '.Глух'
	else:	
		cells_code = ''.join(clean_cells)
		
	mats_code = ''.join(clean_mats)	

	# Описание ограждения
	ogr_list = []
	for main in main_members:		
		if int(main.LookupParameter('Ограждение_Высота').AsValueString()) > 0: 
			ogr_list.append(1)
	
	ogr_code = ograjdenie (ogr_list)
	
	
	return main_code + dimensions (elem_list) + cells_code + mats_code + ogr_code + visor


def create_group (ids):
	
	groups = FilteredElementCollector(doc).OfCategory(BuiltInCategory.OST_IOSModelGroups).WhereElementIsElementType().ToElements()	
	des_name = description (element_list)
	
	if des_name in [group.LookupParameter('Имя типа').AsValueString() for group in groups]:
		
		
		same_groups = []
		for gr in groups:		
			dub_gr = des_name + ' (Копия'
			if des_name == gr.LookupParameter('Имя типа').AsValueString() or dub_gr in gr.LookupParameter('Имя типа').AsValueString():
				same_groups.append(1)
		

		num_groups = sum(same_groups)
		new_name = des_name + ' (Копия ' + str(num_groups) + ')'
		
		alert_text = "Создана копия группы:\n\n" + new_name + " \n \nСравните эту группу с ориганльной группой, если они разные, переименуйте новую группу вручную. (Нужно дописать то, чем она отличается от оригинальной группы. Например _Решетка_Фрамуга, или что-то подобное). \n\nИмя новой группы скопировано в буфер обмена. \n\nИспользуйте поиск в диспетчере проекта. Просто нажмите правой кнопкой в диспетчере - Поиск и CTRL+V"
		
		title = 'Предупреждение!'  
				
		MessageBox.Show( alert_text, title)	
		
		Clipboard.SetText(new_name)		
						
		new_group = doc.Create.NewGroup(selected_ids)
		new_group.GroupType.Name = new_name
		
		
	else:
		new_name = des_name
		new_group = doc.Create.NewGroup(selected_ids)
		new_group.GroupType.Name = new_name


# Функция сортировки модулей внутри групп по порядковому номеру	
def sorting (group_members):
	
	# Берем скписок модулей (рам)
	main_members = []	
	for gr_member in group_members:
		if "Окн_Вит_Витраж" == gr_member.Name:
			main_members.append(gr_member)	
	
	# Группируем по высоте
	groups_main_members = {}
	for main_member in main_members:		
		
		if str(location_up (main_member)) in groups_main_members:
			groups_main_members[str(location_up (main_member))].append(main_member)				
		else:
			groups_main_members[str(location_up (main_member))] = [main_member]	
	
	# Переделываем текст ключа в число
	digital_groups_main_members = []	
	for groups_main_member in groups_main_members.items():
		digit = float(groups_main_member[0])
		digital_groups_main_members.append([digit,groups_main_member[1]])
	
	# Сортируем список по возрастанию уровней
	sorted_main_members = sorted (digital_groups_main_members, key = itemgetter(0))		
	
	cleaned_lists_mains = []	
	for level in sorted_main_members:		
		mains = []		
		for main in level[1]:			
			mains.append([main, main.LookupParameter('Порядковый_Номер').AsInteger()])		
			# Сортируем модули внутри каждого уровня по порядковому номеру
			sorted_mains = sorted(mains, key = itemgetter(1))			
		
		# Добавляем модули отсортированные и без ключа			
		cleaned_lists_mains.append([i[0] for i in sorted_mains])	
	
	return   cleaned_lists_mains


def check(list_levels):
	mistakes = []
	mistakes_num = []
	mistakes_glass = []
	mistakes_position = []
	mistakes_warm = []
	mistakes_profile = []
	for enum, level in enumerate(list_levels):
		
		level_num = str(enum + 1)		
		modules_numbers = [module.LookupParameter('Порядковый_Номер').AsInteger() for module in level]
		count_modules = level.Count
		count_numbers = list(set(modules_numbers)).Count
		
		if count_modules == count_numbers:
			pass
		else:	
			mistakes_num.append(level_num)	
	
		modules_glass = [module.LookupParameter('Остекление').AsInteger() for module in level]
		modules_glass_list = list(set(modules_glass))
		
		if len(modules_glass_list) == 1:
			pass
		else:
			mistakes_glass.append(level_num)
		
		modules_position = [module.LookupParameter('Наружный').AsInteger() for module in level]
		modules_position_list = list(set(modules_position))
		
		if len(modules_position_list) == 1:
			pass
		else:
			mistakes_position.append(level_num)
		
		modules_profile = [module.LookupParameter('Профиль').AsInteger() for module in level]
		modules_profile_list = list(set(modules_profile))
		
		if len(modules_profile_list) == 1:
			pass
		else:
			mistakes_profile.append(level_num)
		
		modules_warm = [module.LookupParameter('Холодный').AsInteger() for module in level]
		modules_warm_list = list(set(modules_warm))
		
		if len(modules_warm_list) == 1:
			pass
		else:
			mistakes_warm.append(level_num)
	
		
	#mistakes_num_text = 'Найдены ошибки порядковой нумерации в уровнях: ' + ','.join(mistakes_num)
	#mistakes_glass_text = 'Не у всех витражей одинаковое остекление в уровнях: ' + ','.join(mistakes_glass)
	#mistakes_position_text = 'Есть и наружные и внутренние витражи в уровнях: ' + ','.join(mistakes_position)	
	#mistakes_warm_text = 'Есть и холодные и теплые витражи в уровнях: ' + ','.join(mistakes_warm)
	#mistakes_profile_text = 'Не у всех витражей одинаковый профиль в уровнях: ' + ','.join(mistakes_profile)
	
	mistakes_num_text = '' if len(mistakes_num) == 0 else 'Найдены ошибки порядковой нумерации в уровнях: ' + ','.join(mistakes_num) + '\n'
	mistakes_glass_text = '' if len(mistakes_glass) == 0 else 'Разное остекление у витражей в уровнях: ' + ','.join(mistakes_glass) + '\n'
	mistakes_position_text = '' if len(mistakes_position) == 0 else 'Есть и наружные и внутренние витражи в уровнях: ' + ','.join(mistakes_position) + '\n'
	mistakes_warm_text = '' if len(mistakes_warm) == 0 else 'Есть и холодные и теплые витражи в уровнях: ' + ','.join(mistakes_warm) + '\n'
	mistakes_profile_text = '' if len(mistakes_profile) == 0 else 'Не у всех витражей одинаковый профиль в уровнях: ' + ','.join(mistakes_profile)
	
	mistakes_text = mistakes_num_text + mistakes_glass_text + mistakes_position_text + mistakes_warm_text + mistakes_profile_text

	
	if len(mistakes_num) > 0 or len(mistakes_glass) > 0 or len(mistakes_position) > 0 or len(mistakes_warm) > 0 or len(mistakes_profile) > 0:
		MessageBox.Show( mistakes_text, 'Ошибки в витражах!')
		return False
	else:
		return True
		
# --------------------------------------------------------------------------------------------

doc = DocumentManager.Instance.CurrentDBDocument
uiapp = DocumentManager.Instance.CurrentUIApplication
app = uiapp.Application
uidoc = DocumentManager.Instance.CurrentUIApplication.ActiveUIDocument

# --------------------------------------------------------------------------------------------

# Выбераем элементы в модели
selected_ids = uidoc.Selection.GetElementIds()


TransactionManager.Instance.EnsureInTransaction(doc)

element_list = []
for id in selected_ids:	
	element_list.append(doc.GetElement(id))



if check(sorting (element_list)):
	create_group (element_list)
else:
	MessageBox.Show( 'Группа не создана изза ошибок в построении витража', 'Ошибка')
	
	

TransactionManager.Instance.TransactionTaskDone()
# ----------------------------------------

# group: Для разработчика
python_script = Python()  # IronPython2; frozen
# ---------- python_script.python (13 lines) ----------
import codecs
import os.path

path = r"W:\Проектный институт\Отд.стандарт.BIM и RD\BIM-Ресурсы\4-Dynamo\Архив\BIM-отдел\Dynamo_new_report.py"

result = ""

if os.path.exists(path):
	with codecs.open(path, 'r', encoding="utf-8") as file:
		for line in file.readlines():
			result += line

OUT = result
# ----------------------------------------
python_script_from_string = PythonStringNode(script=python_script)  # IronPython2
