# Dynamo graph script.dyn "Витражи - №5_Создание эскизов" (Dynamo 2.12.1.8246)

# group: ОПИСАНИЕ! ПРОЧИТАТЬ ПЕРЕД ЗАПУСКОМ!
# note: Скрипт "Витражи - №5_Создание эскизов"
# Версия 2.1
# Разработал: Козлов Павел
# ЧТО ДЕЛАЕТ:
# Создает чертежные виды по имени типа витража. Вставляет 2D-ассоциированные семейства 3D-витража на данный чертежный вид
# КАК ПОЛЬЗОВАТЬСЯ:
# 1. Выбрать группу(ы) витража в модели или в спецификации
# 2. Запустить скрипт

# group: Для разработчика
python_script = Python()  # IronPython2; frozen
# ---------- python_script.python (13 lines) ----------
import codecs
import os.path

path = r"W:\Проектный институт\Отд.стандарт.BIM и RD\BIM-Ресурсы\4-Dynamo\Архив\BIM-отдел\Dynamo_new_report.py"

result = ""

if os.path.exists(path):
	with codecs.open(path, 'r', encoding="utf-8") as file:
		for line in file.readlines():
			result += line

OUT = result
# ----------------------------------------
python_script_from_string = PythonStringNode(script=python_script)  # IronPython2

code_block = CodeBlock { "ЭлУз_Вит_Рама"; }
byName = FamilyType.ByName(name=code_block)
code_block_2 = CodeBlock { "ЭлУз_Вит_Ячейка_1x1"; }
byName_2 = FamilyType.ByName(name=code_block_2)
code_block_3 = CodeBlock { "ЭлУз_Вит_Ячейка_1x2"; }
byName_3 = FamilyType.ByName(name=code_block_3)
code_block_4 = CodeBlock { "ЭлУз_Вит_Ячейка_1x3"; }
byName_4 = FamilyType.ByName(name=code_block_4)
code_block_5 = CodeBlock { "ЭлУз_Вит_Ячейка_Дверь"; }
byName_5 = FamilyType.ByName(name=code_block_5)
code_block_6 = CodeBlock { "ЭлУз_Вит_Ячейка_Пустая"; }
byName_6 = FamilyType.ByName(name=code_block_6)
code_block_7 = CodeBlock { "ЭлУз_Вит_Козырек"; }
byName_7 = FamilyType.ByName(name=code_block_7)
перезапуск = BoolSelector(false)
создание_эскизов = Python(IN[0]=byName, IN[1]=byName_2, IN[2]=byName_3, IN[3]=byName_4, IN[4]=byName_5, IN[5]=byName_6, IN[6]=byName_7, IN[7]=перезапуск)  # IronPython2
# ---------- создание_эскизов.python (570 lines) ----------
import clr
clr.AddReference('ProtoGeometry')
clr.AddReference("System.Windows.Forms")
from Autodesk.DesignScript.Geometry import *
clr.AddReference("RevitServices")
import RevitServices
from RevitServices.Persistence import DocumentManager
from RevitServices.Transactions import TransactionManager
clr.AddReference("RevitAPI")
import Autodesk
from Autodesk.Revit.DB import *
from System.Collections.Generic import *
from operator import itemgetter
clr.AddReference("RevitNodes")
import Revit
clr.ImportExtensions(Revit.Elements)
import itertools
from itertools import groupby
import os
import System


# Функция, активатор загруженных семейств
def activation (family):
	if family.IsActive == False:
		return family.Activate()
		
		
# Функция, которая из всех выделенных групп, берет по одной
def group_instance (list_id):
	
	all_elements = []	
	for id in list_id:	
		noname_element = doc.GetElement(id)		
		if "Группы модели" == noname_element.Category.Name:		
			all_elements.append(noname_element)
		
	groups = {}		
	for group in all_elements:
		groupby_value = group.Name
					
		if groupby_value in groups:
			groups[groupby_value].append(group)				
		else:
			groups[groupby_value] = [group]	
	
	elements = []	
	for element in groups.Values:
		elements.append(element[0])
	
	return elements


# Функция, которая возвращает членов группы
def group_members (group):

	gr_members_ids = group.GetMemberIds()		
	list_of_members = []
	for id in gr_members_ids:		
		member = doc.GetElement(id)
		list_of_members.append(member)
	return list_of_members 

	
# Функция, которая создает чертежный вид и возвращает его
def create_draft (name):

	viewfamily_types = FilteredElementCollector(doc).OfClass(ViewFamilyType)	
	for i in viewfamily_types:
		if i.ViewFamily == ViewFamily.Drafting:
			drafting_view_id = i.Id

	try:
		drafting_view = ViewDrafting.Create(doc, drafting_view_id)		
		drafting_view.Name = 'Эскиз_Витража_' + name
		drafting_view.LookupParameter('Масштаб вида').Set(20)
		#drafting_view.LookupParameter('_Группа Видов').Set('Витражи')
			
	except:
		pass	
	
	return drafting_view


# Функция, которая вставляет элемент узла в чертежный вид по заданным координатам
def put (coordinates, drafting_type, draft):		
	return doc.Create.NewFamilyInstance(coordinates, drafting_type, draft)


# --------------------------------------------------------------------------------------------	
# ФУНКЦИИ МОДУЛЕЙ
# --------------------------------------------------------------------------------------------


# Функция, которая возвращает верхнюю точку для того, чтобы сгруппировать модули по высоте, если витраж многоуровневый
def location_up (element):
	
	point_down = element.Location.Point.Z * 304.8
	hieght = element.LookupParameter('ФОП_РАЗМ_Высота').AsDouble() * 304.8
	point_up = point_down + hieght	
	return round(point_up)
	
	
# Функция сортировки модулей внутри групп по порядковому номеру	
def sorting (group):
	
	# Берем скписок модулей (рам)
	main_members = []	
	for gr_member in group_members (group):
		if "Окн_Вит_Витраж" == gr_member.Name:
			main_members.append(gr_member)	
	
	# Группируем по высоте
	groups_main_members = {}
	for main_member in main_members:		
		
		if str(location_up (main_member)) in groups_main_members:
			groups_main_members[str(location_up (main_member))].append(main_member)				
		else:
			groups_main_members[str(location_up (main_member))] = [main_member]	
	
	# Переделываем текст ключа в число
	digital_groups_main_members = []	
	for groups_main_member in groups_main_members.items():
		digit = float(groups_main_member[0])
		digital_groups_main_members.append([digit,groups_main_member[1]])
	
	# Сортируем список по возрастанию уровней
	sorted_main_members = sorted (digital_groups_main_members, key = itemgetter(0))		
	
	cleaned_lists_mains = []	
	for level in sorted_main_members:		
		mains = []		
		for main in level[1]:			
			mains.append([main, main.LookupParameter('Порядковый_Номер').AsInteger()])		
			# Сортируем модули внутри каждого уровня по порядковому номеру
			sorted_mains = sorted(mains, key = itemgetter(1))			
		
		# Добавляем модули отсортированные и без ключа			
		cleaned_lists_mains.append([i[0] for i in sorted_mains])	
	
	return   cleaned_lists_mains
	

# Функция получения координат рам по ширине		
def mod_xyz_x (list_modules):
	
	# Берем половинки каждого модуля и в список	
	half_first = []
	half_second = []		
	for module in list_modules:		
		width_left = module.LookupParameter('Длина_Слева').AsDouble()
		width_right = module.LookupParameter('Длина_Справа').AsDouble()
		
		half_first.append(width_right)
		half_second.append(width_left)
	
	# Удаляем первое значение	
	half_second.pop(0)
	# Добавляем в конец 0, так как смещаемся к концу
	half_second.append(0)
	# Складываем списки поэлементно
	sum_halfs = map(sum, zip(half_first, half_second))	
	# Добавляем 0 так как первый модуль на 0.0.0	
	sum_halfs.insert(0,0)
	# Удаляем последнее значение	
	sum_halfs.pop((len(sum_halfs)-1))
	
	# Складываем всё поочередно для цепочки координат от нуля (0.0.0)	
	start = sum_halfs[0]	
	result = []
	for item in sum_halfs:		
		result.append(item + start)
		start += item	
	
	return result

# Функция получения координат рам по высоте	
def mod_xyz_y (list_list_modules):
	
	height_all = []
	height_list = []
	
	# берем список списков рам
	for list_modules in list_list_modules:
		# берем список высот рам	
		heights = [h.LookupParameter('ФОП_РАЗМ_Высота').AsDouble() for h in list_modules]				
		# отнимаем от самой высокой поочередно все и ищем отступ от низа
		height_list.append(max(heights))			
		for h in heights:
			height_all.append(max(heights) - h)		
			 
	# Добавляем 0 так как первый модуль на 0.0.0	
	height_list.insert(0,0)
	# Удаляем последнее значение	
	height_list.pop((len(height_list)-1))
	
	# Складываем всё поочередно для цепочки координат от нуля (0.0.0)	
	start = height_list[0]	
	result = []
	for item in height_list:		
		result.append(item + start)
		start += item	
	
	return result, height_all
	
	
# Функция назначения параметров раме
def module_parameter (lev_num, level, num, mod_3D, mod_2D, list_all_modules, offset_m):
	
	mod_2D.LookupParameter('Витраж_Ширина').Set(mod_3D.LookupParameter('Витраж_Ширина').AsDouble())
	mod_2D.LookupParameter('Витраж_Высота').Set(mod_3D.LookupParameter('ФОП_РАЗМ_Высота проёма').AsDouble())
	mod_2D.LookupParameter('Ограждение_Высота').Set(mod_3D.LookupParameter('Ограждение_Высота').AsDouble())	
	mod_2D.LookupParameter('Монтажный_Зазор_Сверху').Set(mod_3D.LookupParameter('Монтажный_Зазор_Сверху').AsDouble())
	mod_2D.LookupParameter('Монтажный_Зазор_Снизу').Set(mod_3D.LookupParameter('Монтажный_Зазор_Снизу').AsDouble())
	mod_2D.LookupParameter('Монтажный_Зазор_Слева').Set(mod_3D.LookupParameter('Монтажный_Зазор_Слева').AsDouble())
	mod_2D.LookupParameter('Монтажный_Зазор_Справа').Set(mod_3D.LookupParameter('Монтажный_Зазор_Справа').AsDouble())	
	mod_2D.LookupParameter('Импост_Слева').Set(mod_3D.LookupParameter('Импост_Слева').AsInteger())
	mod_2D.LookupParameter('Импост_Справа').Set(mod_3D.LookupParameter('Импост_Справа').AsInteger())
	mod_2D.LookupParameter('Импост_Сверху').Set(mod_3D.LookupParameter('Импост_Сверху').AsInteger())
	mod_2D.LookupParameter('Импост_Снизу').Set(mod_3D.LookupParameter('Импост_Снизу').AsInteger())	
	mod_2D.LookupParameter('Импост_Ширина').Set(mod_3D.LookupParameter('Импост_Ширина').AsDouble())	
	mod_2D.LookupParameter('Импост_Слева_Регулируемый').Set(mod_3D.LookupParameter('Импост_Слева_Регулируемый').AsInteger())
	mod_2D.LookupParameter('Импост_Справа_Регулируемый').Set(mod_3D.LookupParameter('Импост_Справа_Регулируемый').AsInteger())
	mod_2D.LookupParameter('Угловой_Нащельник_Слева_Регулируемый').Set(mod_3D.LookupParameter('Угловой_Нащельник_Слева_Регулируемый').AsInteger())
	mod_2D.LookupParameter('Угловой_Нащельник_Справа_Регулируемый').Set(mod_3D.LookupParameter('Угловой_Нащельник_Справа_Регулируемый').AsInteger())
	mod_2D.LookupParameter('Смещение_Нащельника_Слева').Set(mod_3D.LookupParameter('Смещение_Нащельника_Слева').AsDouble())
	mod_2D.LookupParameter('Смещение_Нащельника_Справа').Set(mod_3D.LookupParameter('Смещение_Нащельника_Справа').AsDouble())		
	mod_2D.LookupParameter('Импост_Слева_Высота').Set(mod_3D.LookupParameter('Импост_Слева_Высота').AsDouble())
	mod_2D.LookupParameter('Импост_Справа_Высота').Set(mod_3D.LookupParameter('Импост_Справа_Высота').AsDouble())	
	mod_2D.LookupParameter('Угловой_Нащельник_Левый_Видимость').Set(mod_3D.LookupParameter('Угловой_Нащельник_Левый_Видимость').AsInteger())
	mod_2D.LookupParameter('Угловой_Нащельник_Правый_Видимость').Set(mod_3D.LookupParameter('Угловой_Нащельник_Правый_Видимость').AsInteger())	
	mod_2D.LookupParameter('Первый_По_Ширине').Set(mod_3D.LookupParameter('Первый_По_Ширине').AsInteger())
	mod_2D.LookupParameter('Промежуточный_По_Ширине').Set(mod_3D.LookupParameter('Промежуточный_По_Ширине').AsInteger())
	mod_2D.LookupParameter('Последний_По_Ширине').Set(mod_3D.LookupParameter('Последний_По_Ширине').AsInteger())	
	mod_2D.LookupParameter('Первый_По_Высоте').Set(mod_3D.LookupParameter('Первый_По_Высоте').AsInteger())
	mod_2D.LookupParameter('Промежуточный_По_Высоте').Set(mod_3D.LookupParameter('Промежуточный_По_Высоте').AsInteger())
	mod_2D.LookupParameter('Последний_По_Высоте').Set(mod_3D.LookupParameter('Последний_По_Высоте').AsInteger())
	
	mod_2D.LookupParameter('Отступ_Витража').Set(offset_m - mod_3D.LookupParameter('Монтажный_Зазор_Снизу').AsDouble()) if offset_m > 0 else mod_2D.LookupParameter('Отступ_Витража').Set(offset_m)
	mod_2D.LookupParameter('Отступ_Размера_Низ').Set(offset_m + 0.4921259842519685)
	mod_2D.LookupParameter('Отступ_Размера_Низ_Общий').Set(offset_m + 1.640419947506562)


	sum_height = sum([list_modules[(len(level) - 1)].LookupParameter('ФОП_РАЗМ_Высота проёма').AsDouble() for list_modules in list_all_modules])
	sum_width = sum([w.LookupParameter('ФОП_РАЗМ_Ширина проёма').AsDouble() for w in level])
	
	if lev_num == 0:		
		mod_2D.LookupParameter('Нижние_Размеры').Set(1)		
		
		if num == 0:
			mod_2D.LookupParameter('Размер_Общий_Снизу').Set(1)			
			mod_2D.LookupParameter('Размер_Общий_Снизу_Значение').Set(sum_width)
			mod_2D.LookupParameter('Левые_Размеры').Set(1) if offset_m > 0 else mod_2D.LookupParameter('Левые_Размеры').Set(0)
		else:
			mod_2D.LookupParameter('Размер_Общий_Снизу').Set(0)
			mod_2D.LookupParameter('Левые_Размеры').Set(0)			
		
		if num == (len(level) - 1):
			mod_2D.LookupParameter('Правые_Размеры').Set(1)
			mod_2D.LookupParameter('Размер_Общий_Справа').Set(1)
			mod_2D.LookupParameter('Размер_Общий_Слева').Set(0)			
			mod_2D.LookupParameter('Размер_Общий_Справа_Значение').Set(sum_height)			
			mod_2D.LookupParameter('Размер_Общий_Вручную_Справа_Значение').Set(sum_height)
			
		else:
			mod_2D.LookupParameter('Правые_Размеры').Set(0)
			mod_2D.LookupParameter('Размер_Общий_Справа').Set(0)
			mod_2D.LookupParameter('Размер_Общий_Слева').Set(0)
	else:
		
		mod_2D.LookupParameter('Нижние_Размеры').Set(0)		
		mod_2D.LookupParameter('Размер_Общий_Снизу').Set(0)
				
		
		if num == (len(level) - 1):
			mod_2D.LookupParameter('Правые_Размеры').Set(1)
			mod_2D.LookupParameter('Размер_Общий_Справа').Set(0)
			mod_2D.LookupParameter('Размер_Общий_Слева').Set(0)
			mod_2D.LookupParameter('Левые_Размеры').Set(0)
		else:
			mod_2D.LookupParameter('Правые_Размеры').Set(0)
			mod_2D.LookupParameter('Размер_Общий_Справа').Set(0)
			mod_2D.LookupParameter('Размер_Общий_Слева').Set(0)
			mod_2D.LookupParameter('Левые_Размеры').Set(0)


# --------------------------------------------------------------------------------------------	
# ФУНКЦИИ ЯЧЕЕК
# --------------------------------------------------------------------------------------------	


# Функция, которая возвращает вложенные семейства
def fam_members (fam):

	members_ids = fam.GetSubComponentIds()			
	list_of_members = []
	for id in members_ids:		
		member = doc.GetElement(id)
		list_of_members.append(member)

	return list_of_members 


# Функция получения координат ячеек по высоте	
def cell_xyz_y (list_cel):	
	
	heights = [h.LookupParameter('Высота').AsDouble() for h in list_cel]	
	# Добавляем 0 так как первый модуль на 0.0.0	
	heights.insert(0,0)
	# Удаляем последнее значение	
	heights.pop((len(heights)-1))
	
	# Складываем всё поочередно для цепочки координат от нуля (0.0.0)	
	start = heights[0]	
	result = []
	for item in heights:		
		result.append(item + start)
		start += item
		
	return result


def cell_mats (name):
	if 'решетка' in name.lower():
		return 4
	elif 'тонированн' in name.lower():
		return 3
	elif 'закаленн' in name.lower():
		return 2	
	elif 'сэндвич' in name.lower():
		return 5
	elif 'воздух' in name.lower():
		return 6
	else: 
		return 1
		

def cells_varios (ce_2D, ce_3D):
	
	if 'Окн_Вит_Ячейка_1х1' in ce_3D.Symbol.Family.Name:	
		ce_2D.LookupParameter('Код_Открывания').Set(ce_3D.Symbol.LookupParameter('Код_Открывания').AsInteger())
		ce_2D.LookupParameter('Заполнение_Материал').Set(cell_mats(ce_3D.Symbol.LookupParameter('Заполнение_Материал').AsValueString()))
		ce_2D.LookupParameter('Крестик').Set(ce_3D.Symbol.LookupParameter('Крестик').AsInteger())
	
	elif 'Окн_Вит_Ячейка_Пустая' in ce_3D.Symbol.Family.Name:	
		ce_2D.LookupParameter('Заполнение_Материал').Set(cell_mats(ce_3D.Symbol.LookupParameter('Заполнение_Материал').AsValueString()))
		
	elif 'Окн_Вит_Ячейка_1х2' in ce_3D.Symbol.Family.Name:	
		ce_2D.LookupParameter('Код_Открывания_Левая_Створка').Set(ce_3D.Symbol.LookupParameter('Код_Открывания_Левая_Створка').AsInteger())
		ce_2D.LookupParameter('Код_Открывания_Правая_Створка').Set(ce_3D.Symbol.LookupParameter('Код_Открывания_Правая_Створка').AsInteger())
		ce_2D.LookupParameter('Заполнение_Материал_Левая_Створка').Set(cell_mats(ce_3D.Symbol.LookupParameter('Заполнение_Материал_Левая_Створка').AsValueString()))
	 	ce_2D.LookupParameter('Заполнение_Материал_Правая_Створка').Set(cell_mats(ce_3D.Symbol.LookupParameter('Заполнение_Материал_Правая_Створка').AsValueString()))
	 	ce_2D.LookupParameter('Равные_Створки').Set(ce_3D.Symbol.LookupParameter('Равные_Створки').AsInteger())
		ce_2D.LookupParameter('Крестик').Set(ce_3D.Symbol.LookupParameter('Крестик').AsInteger())
		ce_2D.LookupParameter('Ширина_Левой_Створки').Set(ce_3D.Symbol.LookupParameter('Ширина_Левой_Створки').AsDouble())
		ce_2D.LookupParameter('Высота_Окна_Выдачи').Set(ce_3D.Symbol.LookupParameter('Высота_Окна_Выдачи').AsDouble())
		
	elif 'Окн_Вит_Ячейка_1х3' in ce_3D.Symbol.Family.Name:	
		ce_2D.LookupParameter('Код_Открывания_Левая_Створка').Set(ce_3D.Symbol.LookupParameter('Код_Открывания_Левая_Створка').AsInteger())
		ce_2D.LookupParameter('Код_Открывания_Центр_Створка').Set(ce_3D.Symbol.LookupParameter('Код_Открывания_Центр_Створка').AsInteger())
		ce_2D.LookupParameter('Код_Открывания_Правая_Створка').Set(ce_3D.Symbol.LookupParameter('Код_Открывания_Правая_Створка').AsInteger())
		ce_2D.LookupParameter('Заполнение_Материал_Левая_Створка').Set(cell_mats(ce_3D.Symbol.LookupParameter('Заполнение_Материал_Левая_Створка').AsValueString()))
		ce_2D.LookupParameter('Заполнение_Материал_Центр_Створка').Set(cell_mats(ce_3D.Symbol.LookupParameter('Заполнение_Материал_Центр_Створка').AsValueString()))
	 	ce_2D.LookupParameter('Заполнение_Материал_Правая_Створка').Set(cell_mats(ce_3D.Symbol.LookupParameter('Заполнение_Материал_Правая_Створка').AsValueString()))
	 	ce_2D.LookupParameter('Равные_Створки').Set(ce_3D.Symbol.LookupParameter('Равные_Створки').AsInteger())
	 	ce_2D.LookupParameter('Развернуть открывание').Set(ce_3D.Symbol.LookupParameter('Развернуть открывание').AsInteger())
		ce_2D.LookupParameter('Крестик').Set(ce_3D.Symbol.LookupParameter('Крестик').AsInteger())
		ce_2D.LookupParameter('Ширина_Левой_Створки').Set(ce_3D.Symbol.LookupParameter('Ширина_Левой_Створки').AsDouble())
		ce_2D.LookupParameter('Ширина_Центр_Створки').Set(ce_3D.Symbol.LookupParameter('Ширина_Центр_Створки').AsDouble())

	elif 'Окн_Вит_Ячейка_Дверь' in ce_3D.Symbol.Family.Name:	
		ce_2D.LookupParameter('Код_Открывания').Set(ce_3D.Symbol.LookupParameter('Код_Открывания').AsInteger())
		ce_2D.LookupParameter('Домофонная_Панель_Слева').Set(ce_3D.Symbol.LookupParameter('Домофонная_Панель_Слева').AsInteger())
		ce_2D.LookupParameter('Домофонная_Панель_Справа').Set(ce_3D.Symbol.LookupParameter('Домофонная_Панель_Справа').AsInteger())
		ce_2D.LookupParameter('Домофонная_Панель_Ширина_Слева').Set(ce_3D.Symbol.LookupParameter('Домофонная_Панель_Ширина_Слева').AsDouble())
		ce_2D.LookupParameter('Домофонная_Панель_Ширина_Справа').Set(ce_3D.Symbol.LookupParameter('Домофонная_Панель_Ширина_Справа').AsDouble())		
		ce_2D.LookupParameter('Заполнение_Материал').Set(cell_mats(ce_3D.Symbol.LookupParameter('Заполнение_Материал').AsValueString()))
		ce_2D.LookupParameter('Заполнение_Материал_Домофонная_Панель').Set(cell_mats(ce_3D.Symbol.LookupParameter('Заполнение_Материал_Домофонная_Панель').AsValueString()))
	 	ce_2D.LookupParameter('Ширина_Большой_Створки').Set(ce_3D.Symbol.LookupParameter('Ширина_Большой_Створки').AsDouble())		


		
def cell_parameter(c_num, m_num, l_num, mod_3D, lev, lev_list, c_2D, c_3D, offset_c):
	
	cells_varios (c_2D, c_3D)	
	
	c_2D.LookupParameter('Импост_Ширина').Set(c_3D.LookupParameter('Импост_Ширина').AsDouble())	
	c_2D.LookupParameter('Высота').Set(c_3D.LookupParameter('Высота').AsDouble())
	c_2D.LookupParameter('Ширина').Set(c_3D.LookupParameter('Ширина').AsDouble())
	c_2D.LookupParameter('Импост_Верхний_Видимость').Set(c_3D.LookupParameter('Импост_Верхний_Видимость').AsInteger())
	c_2D.LookupParameter('Импост_Нижний_Видимость').Set(c_3D.LookupParameter('Импост_Нижний_Видимость').AsInteger())
		
	c_2D.LookupParameter('Первая_По_Шир').Set(mod_3D.LookupParameter('Первый_По_Ширине').AsInteger())
	c_2D.LookupParameter('Промежуточная_По_Шир').Set(mod_3D.LookupParameter('Промежуточный_По_Ширине').AsInteger())
	c_2D.LookupParameter('Последняя_По_Шир').Set(mod_3D.LookupParameter('Последний_По_Ширине').AsInteger())
	
	c_2D.LookupParameter('Отступ_Размера_Низ').Set(offset_c + 0.4921259842519685)	
		
		
	c_2D.LookupParameter('Левые_Размеры').Set(1) if m_num == 0 and offset_c > 0 else c_2D.LookupParameter('Левые_Размеры').Set(0)	
	c_2D.LookupParameter('Правые_Размеры').Set(1) if m_num == len(lev) - 1 else c_2D.LookupParameter('Правые_Размеры').Set(0)	
	c_2D.LookupParameter('Нижние_Размеры').Set(1) if c_num == 0 and l_num == 0 else c_2D.LookupParameter('Нижние_Размеры').Set(0)
				
	if  1 == len(fam_members(mod_3D)):
		c_2D.LookupParameter('Первая_По_Выс').Set(1)
		c_2D.LookupParameter('Промежуточная_По_Выс').Set(0)
		c_2D.LookupParameter('Последняя_По_Выс').Set(1)
		
	elif c_num == 0 and l_num == 0:
		c_2D.LookupParameter('Первая_По_Выс').Set(1)
		c_2D.LookupParameter('Промежуточная_По_Выс').Set(0)
		c_2D.LookupParameter('Последняя_По_Выс').Set(0)		
	
	elif c_num == (len(fam_members(mod_3D)) - 1) and 1 == mod_3D.LookupParameter('Последний_По_Высоте').AsInteger():
		c_2D.LookupParameter('Первая_По_Выс').Set(0)
		c_2D.LookupParameter('Промежуточная_По_Выс').Set(0)
		c_2D.LookupParameter('Последняя_По_Выс').Set(1)
	
	elif c_num == (len(fam_members(mod_3D)) - 1) and (0 == mod_3D.LookupParameter('Первый_По_Высоте').AsInteger() and 0 == mod_3D.LookupParameter('Промежуточный_По_Высоте').AsInteger() and 0 == mod_3D.LookupParameter('Последний_По_Высоте').AsInteger()):
		c_2D.LookupParameter('Первая_По_Выс').Set(0)
		c_2D.LookupParameter('Промежуточная_По_Выс').Set(0)
		c_2D.LookupParameter('Последняя_По_Выс').Set(1)
		
	else: 
		c_2D.LookupParameter('Первая_По_Выс').Set(0)
		c_2D.LookupParameter('Промежуточная_По_Выс').Set(1)
		c_2D.LookupParameter('Последняя_По_Выс').Set(0)
	
	
def visor_x_y (ele_vis_3D, lis_ma_mod):	
	
	zero_x = lis_ma_mod[0][0]
	zero_visor_x = zero_x.LookupParameter('Длина_Слева').AsDouble()
	x = ele_vis_3D[0].LookupParameter('Отступ_От_Левого_Края').AsDouble() - zero_visor_x
	y = ele_vis_3D[0].LookupParameter('Отступ_От_Нижнего_Края').AsDouble()
		
	return x, y
	
def visor_parameter(el_vis_2D, el_vis_3D):	
	
	el_vis_2D.LookupParameter('Высота подъема').Set(el_vis_3D.LookupParameter('Высота подвеса').AsDouble())
	el_vis_2D.LookupParameter('Ширина').Set(el_vis_3D.LookupParameter('Ширина').AsDouble())
	

def draft_varios (cel_3D):
	
	if 'Окн_Вит_Ячейка_1х1' in cel_3D.Symbol.Family.Name:	
		return draft_1x1	
	elif 'Окн_Вит_Ячейка_1х2' in cel_3D.Symbol.Family.Name:	
		return draft_1x2		
	elif 'Окн_Вит_Ячейка_1х3' in cel_3D.Symbol.Family.Name:	
		return draft_1x3
	elif 'Окн_Вит_Ячейка_Дверь' in cel_3D.Symbol.Family.Name:	
		return draft_door
	elif 'Окн_Вит_Ячейка_Пустая' in cel_3D.Symbol.Family.Name:	
		return draft_empty

# --------------------------------------------------------------------------------------------			
# --------------------------------------------------------------------------------------------
# Основная функция
# --------------------------------------------------------------------------------------------			
# --------------------------------------------------------------------------------------------	

def main_function (group):

	type_group = doc.GetElement(group.GetTypeId())
	try:
		type_group_name = type_group.LookupParameter('ФОП_Марка типа').AsValueString()
	except:
		type_group_name = type_group.LookupParameter('ФОП_Марка Типа').AsValueString()
		
	# Создаем чертежный вид по ФОП_Марке типа группы витража
	drafting_view = create_draft (type_group_name)	
	
	# Сортируем модули по порядковому номеру
	list_main_modules = sorting (group)	
	
	# Цикл уровней - по высоте. В каждом level - несколько модулей
	for lev_num, level in enumerate (list_main_modules):
		
		
		
		# Цикл модулей в каждом уровне		
		for mod_num, module_3D in enumerate(level):	
			# Смещение модуля по высоте
			offset_mod = mod_xyz_y (list_main_modules)[1][mod_num]
			
			mod_x = mod_xyz_x (level)[mod_num]			
			mod_y = mod_xyz_y (list_main_modules)[0][lev_num] + offset_mod			
			
			module_2D = put ( XYZ(mod_x,mod_y,0), draft_rama, drafting_view)
			module_parameter (lev_num, level, mod_num, module_3D, module_2D, list_main_modules, offset_mod)
			
			DetailElementOrderUtils.SendToBack (doc, drafting_view, module_2D.Id)
			
			# Цикл ячеек в каждом модуле
			for cell_num, cell_3D in enumerate(fam_members (module_3D)):
				
				cell_y = cell_xyz_y (fam_members(module_3D))[cell_num] + mod_y			
								
				cell_2D = put ( XYZ(mod_x,cell_y,0), draft_varios(cell_3D), drafting_view)				
				cell_parameter(cell_num, mod_num, lev_num, module_3D, level, list_main_modules, cell_2D, cell_3D, offset_mod)
				
				DetailElementOrderUtils.SendToBack (doc, drafting_view, cell_2D.Id)	
	
	
	visor_3D = [fam_vis for fam_vis in group_members (group) if 'ОбщМд_Козырек' in fam_vis.Symbol.Family.Name]
	
	if visor_3D:			
		vis_x = visor_x_y ( visor_3D, list_main_modules)[0]
		vis_y = visor_x_y ( visor_3D, list_main_modules)[1]
		
		visor_2D = put ( XYZ(vis_x, vis_y, 0), visor, drafting_view)	
		visor_parameter(visor_2D, visor_3D[0])	
		
		DetailElementOrderUtils.BringToFront (doc, drafting_view, visor_2D.Id)	


# --------------------------------------------------------------------------------------------			
# --------------------------------------------------------------------------------------------
# Переменные
# --------------------------------------------------------------------------------------------			
# --------------------------------------------------------------------------------------------


doc = DocumentManager.Instance.CurrentDBDocument
uiapp = DocumentManager.Instance.CurrentUIApplication
app = uiapp.Application
uidoc = DocumentManager.Instance.CurrentUIApplication.ActiveUIDocument

draft_rama = UnwrapElement(IN[0])
draft_1x1 = UnwrapElement(IN[1])
draft_1x2 = UnwrapElement(IN[2])
draft_1x3 = UnwrapElement(IN[3])
draft_door = UnwrapElement(IN[4])
draft_empty = UnwrapElement(IN[5])
visor = UnwrapElement(IN[6])


# --------------------------------------------------------------------------------------------			
# --------------------------------------------------------------------------------------------
# Транзакция
# --------------------------------------------------------------------------------------------			
# --------------------------------------------------------------------------------------------


TransactionManager.Instance.EnsureInTransaction(doc)


activation (draft_rama)
activation (draft_1x1)
activation (draft_1x2)
activation (draft_1x3)
activation (draft_door)
activation (visor)


# Выбераем элементы в модели
selected_ids = uidoc.Selection.GetElementIds()

# Отделяем только по одному экземпляру из всех выделенных групп
all_groups = group_instance (selected_ids)

# Перебираем каждую группу
for group in all_groups:	
	main_function (group)	

TransactionManager.Instance.TransactionTaskDone()	
	
# ----------------------------------------
