# Dynamo graph script.dyn (Dynamo 2.12.0.5650)

# group: ОПИСАНИЕ! ПРОЧИТАТЬ ПЕРЕД ЗАПУСКОМ!
# note: Скрипт "Двери - Маркировка ГОСТ"
# Версия 1.0
# Разработал: Антипин М. О.
# ЧТО ДЕЛАЕТ:
# КАК ПОЛЬЗОВАТЬСЯ:

стадия_возведения = StringInput("Основная планировка")

# group: Фильтрация семейств Дверей
code_block = CodeBlock { "Двери"; }
byName = Category.ByName(name=code_block)
all_elements_of_category = ElementsOfCategory(Category=byName)
code_block_2 = CodeBlock { "Стадия возведения"; }
getParameterValueByName = Element.GetParameterValueByName(element=all_elements_of_category, parameterName=code_block_2)
name = Element.Name(element=getParameterValueByName)
eq = name == стадия_возведения
filterByBoolMask = List.FilterByBoolMask(list=all_elements_of_category, mask=eq)
elementType = Element.ElementType(element=filterByBoolMask.in)
uniqueItems = List.UniqueItems(list=elementType)
code_block_3 = CodeBlock { "Имя семейства"; }
getParameterValueByName_2 = Element.GetParameterValueByName(element=uniqueItems, parameterName=code_block_3)
code_block_4 = CodeBlock { "Двр_Двр_Однп"; }
contains = String.Contains(string=getParameterValueByName_2, searchFor=code_block_4)
filterByBoolMask_2 = List.FilterByBoolMask(list=uniqueItems, mask=contains)
code_block_5 = CodeBlock { "Двр_Двр_Двуп"; }
contains_2 = String.Contains(string=getParameterValueByName_2, searchFor=code_block_5)
filterByBoolMask_3 = List.FilterByBoolMask(list=uniqueItems, mask=contains_2)
join = List.Join(list0=filterByBoolMask_2.in, list1=filterByBoolMask_3.in)
code_block_6 = CodeBlock { "ФОП_Учитывать в спецификации"; }
getParameterValueByName_3 = Element.GetParameterValueByName(element=join, parameterName=code_block_6)
code_block_7 = CodeBlock { 1; }
eq_2 = getParameterValueByName_3 == code_block_7
filterByBoolMask_4 = List.FilterByBoolMask(list=join, mask=eq_2)

# group: Тип двери (ДВ, ДН)
code_block_8 = CodeBlock { "Имя типа"; }
getParameterValueByName_4 = Element.GetParameterValueByName(element=filterByBoolMask_4.in, parameterName=code_block_8)
# note: Для ФОП_Наименование
python_script = Python(IN[0]=getParameterValueByName_4)  # IronPython2
# ---------- python_script.python (47 lines) ----------
# Загрузить стандартную библиотеку Python и библиотеку DesignScript
import sys
import clr
clr.AddReference('ProtoGeometry')
from Autodesk.DesignScript.Geometry import *

# Введенные в этом узле данные сохраняется в виде списка в переменных IN.
names = IN[0]
pp = 'ПП'
stl = 'Сталь'
alm = 'Алюминий'
pvh = 'ПВХ'
drv = 'Дерево'
dv = 'ДВ'
dn = 'ДН'
outlist = []

# Разместите код под этой строкой
for name in names:
	if stl in name and not pp in name and dv in name:
		outlist.append('ДСВ')
	elif stl in name and not pp in name and dn in name:
		outlist.append('ДСН')
	elif stl in name and pp in name and dv in name:
		outlist.append('ДСВПП')
	elif stl in name and pp in name and dn in name:
		outlist.append('ДСНПП')
	elif alm in name and not pp in name and dv in name:
		outlist.append('ДАВ')
	elif alm in name and not pp in name and dn in name:
		outlist.append('ДАН')
	elif alm in name and pp in name and dv in name:
		outlist.append('ДАВПП')
	elif alm in name and pp in name and dn in name:
		outlist.append('ДАНПП')
	elif drv in name and dv in name:
		outlist.append('ДВ')
	elif drv in name and dn in name:
		outlist.append('ДН')
	elif pvh in name and dv in name:
		outlist.append('ДПВ')
	elif pvh in name and dn in name:
		outlist.append('ДПН')
	else:
		outlist.append('#')
# Назначьте вывод переменной OUT.
OUT = outlist
# ----------------------------------------
# note: Для ФОП_Описание
python_script_2 = Python(IN[0]=getParameterValueByName_4)  # IronPython2
# ---------- python_script_2.python (47 lines) ----------
# Загрузить стандартную библиотеку Python и библиотеку DesignScript
import sys
import clr
clr.AddReference('ProtoGeometry')
from Autodesk.DesignScript.Geometry import *

# Введенные в этом узле данные сохраняется в виде списка в переменных IN.
names = IN[0]
pp = 'ПП'
stl = 'Сталь'
alm = 'Алюминий'
pvh = 'ПВХ'
drv = 'Дерево'
dv = 'ДВ'
dn = 'ДН'
outlist = []

# Разместите код под этой строкой
for name in names:
	if stl in name and not pp in name and dv in name:
		outlist.append('Дверной блок стальной внутренний, группы В, ')
	elif stl in name and not pp in name and dn in name:
		outlist.append('Дверной блок стальной наружный, группы А, ')
	elif stl in name and pp in name and dv in name:
		outlist.append('Дверной блок стальной внутренний, группы В, противопожарный, ')
	elif stl in name and pp in name and dn in name:
		outlist.append('Дверной блок стальной наружный, группы А, противопожарный, ')
	elif alm in name and not pp in name and dv in name:
		outlist.append('Внутренний дверной блок из алюминиевого профиля, ')
	elif alm in name and not pp in name and dn in name:
		outlist.append('Наружный дверной блок из алюминиевого профиля, ')
	elif alm in name and pp in name and dv in name:
		outlist.append('Внутренний дверной блок из алюминиевого профиля, противопожарный, ')
	elif alm in name and pp in name and dn in name:
		outlist.append('Наружный дверной блок из алюминиевого профиля, противопожарный, ')
	elif drv in name and dv in name:
		outlist.append('Дверной блок внутренний, ')
	elif drv in name and dn in name:
		outlist.append('Дверной блок наружный, ')
	elif pvh in name and dv in name:
		outlist.append('Дверной блок из ПВХ-профилей внутренний, группы Б, ')
	elif pvh in name and dn in name:
		outlist.append('Дверной блок из ПВХ-профилей наружный, группы А, ')
	else:
		outlist.append('ТИП БЛОКА НЕ ОПРЕДЕЛЕН/')
# Назначьте вывод переменной OUT.
OUT = outlist
# ----------------------------------------

# group: Количество полотен
code_block_9 = CodeBlock { "Имя семейства"; }
getParameterValueByName_5 = Element.GetParameterValueByName(element=filterByBoolMask_4.in, parameterName=code_block_9)
add = getParameterValueByName_4 + getParameterValueByName_5
# note: Для ФОП_Наименование
python_script_3 = Python(IN[0]=add)  # IronPython2
# ---------- python_script_3.python (38 lines) ----------
# Загрузить стандартную библиотеку Python и библиотеку DesignScript
import sys
import clr
clr.AddReference('ProtoGeometry')
from Autodesk.DesignScript.Geometry import *

# Введенные в этом узле данные сохраняется в виде списка в переменных IN.
names = IN[0]
stl = 'Сталь'
alm = 'Алюминий'
pvh = 'ПВХ'
drv = 'Дерево'
odn = 'Однп'
dvu = 'Двуп'
outlist = []

# Разместите код под этой строкой
for name in names:
	if stl in name and odn in name:
		outlist.append('Оп')
	elif stl in name and dvu in name:
		outlist.append('Дп')
	elif alm in name and odn in name:
		outlist.append('Оп')
	elif alm in name and dvu in name:
		outlist.append('Дв')
	elif pvh in name and odn in name:
		outlist.append('Оп')
	elif pvh in name and dvu in name:
		outlist.append('Дп')
	elif drv in name and odn in name:
		outlist.append('1')
	elif drv in name and dvu in name:
		outlist.append('2')
	else:
		outlist.append('#')
# Назначьте вывод переменной OUT.
OUT = outlist
# ----------------------------------------
# note: Для ФОП_Описание
python_script_4 = Python(IN[0]=getParameterValueByName_5)  # IronPython2
# ---------- python_script_4.python (22 lines) ----------
# Загрузить стандартную библиотеку Python и библиотеку DesignScript
import sys
import clr
clr.AddReference('ProtoGeometry')
from Autodesk.DesignScript.Geometry import *

# Введенные в этом узле данные сохраняется в виде списка в переменных IN.
names = IN[0]
odn = 'Однп'
dvu = 'Двуп'
outlist = []

# Разместите код под этой строкой
for name in names:
	if odn in name:
		outlist.append('однопольный, ')
	elif dvu in name:
		outlist.append('двупольный, ')
	else:
		outlist.append('КОЛИЧЕСТВО ПОЛОТЕН НЕ ОПРЕДЕЛЕНО/')
# Назначьте вывод переменной OUT.
OUT = outlist
# ----------------------------------------

# group: Порог
code_block_10 = CodeBlock { "_П"; }
code_block_11 = CodeBlock { "Порог"; }
getParameterValueByName_6 = Element.GetParameterValueByName(element=filterByBoolMask_4.in, parameterName=code_block_11)
formula = Formula("a+b+c", a=getParameterValueByName_4, b=code_block_10, c=getParameterValueByName_6)
# note: Для ФОП_Наименование
python_script_5 = Python(IN[0]=formula)  # IronPython2
# ---------- python_script_5.python (38 lines) ----------
# Загрузить стандартную библиотеку Python и библиотеку DesignScript
import sys
import clr
clr.AddReference('ProtoGeometry')
from Autodesk.DesignScript.Geometry import *

# Введенные в этом узле данные сохраняется в виде списка в переменных IN.
names = IN[0]
stl = 'Сталь'
alm = 'Алюминий'
pvh = 'ПВХ'
drv = 'Дерево'
prg0 = '_П0'
prg1 = '_П1'
outlist = []

# Разместите код под этой строкой
for name in names:
	if stl in name and prg0 in name:
		outlist.append('Брг')
	elif stl in name and prg1 in name:
		outlist.append('Прг')
	elif alm in name and prg0 in name:
		outlist.append('Бпр')
	elif alm in name and prg1 in name:
		outlist.append('П')
	elif pvh in name and prg0 in name:
		outlist.append('Бпр')
	elif pvh in name and prg1 in name:
		outlist.append('П')
	elif drv in name and prg0 in name:
		outlist.append('ПрБ')
	elif drv in name and prg1 in name:
		outlist.append('Пр')
	else:
		outlist.append('#')
# Назначьте вывод переменной OUT.
OUT = outlist
# ----------------------------------------
# note: Для ФОП_Описание
python_script_6 = Python(IN[0]=getParameterValueByName_6)  # IronPython2
# ---------- python_script_6.python (20 lines) ----------
# Загрузить стандартную библиотеку Python и библиотеку DesignScript
import sys
import clr
clr.AddReference('ProtoGeometry')
from Autodesk.DesignScript.Geometry import *

# Введенные в этом узле данные сохраняется в виде списка в переменных IN.
names = IN[0]
outlist = []

# Разместите код под этой строкой
for name in names:
	if name == 0:
		outlist.append('без порога, ')
	elif name == 1:
		outlist.append('с порогом, ')
	else:
		outlist.append('')
# Назначьте вывод переменной OUT.
OUT = outlist
# ----------------------------------------

# group: Тип полотна
code_block_12 = CodeBlock { "Двр_Двр_Однп"; }
eq_3 = getParameterValueByName_5 == code_block_12
code_block_13 = CodeBlock { "Полотно"; }
code_block_14 = CodeBlock { "Полотно Основное"; }
formula_2 = Formula("if(a=true,b,c)", a=eq_3, b=code_block_13, c=code_block_14)
getParameterValueByName_7 = Element.GetParameterValueByName(element=filterByBoolMask_4.in, parameterName=formula_2)
name_2 = Family.Name(family=getParameterValueByName_7)
code_block_15 = CodeBlock { "_!"; }
formula_3 = Formula("a+b+c", a=getParameterValueByName_4, b=name_2, c=code_block_15)
# note: Для ФОП_Наименование
python_script_7 = Python(IN[0]=formula_3)  # IronPython2
# ---------- python_script_7.python (42 lines) ----------
# Загрузить стандартную библиотеку Python и библиотеку DesignScript
import sys
import clr
clr.AddReference('ProtoGeometry')
from Autodesk.DesignScript.Geometry import *

# Введенные в этом узле данные сохраняется в виде списка в переменных IN.
names = IN[0]
stl = 'Сталь'
alm = 'Алюминий'
pvh = 'ПВХ'
drv = 'Дерево'
gl2 = 'Двр_Плтн_Глухое_!'
gl1 = 'Двр_Плтн_Глухое Однослойное_!'
ost = 'Двр_Плтн_Остекленное_!'
dvfl = 'Двр_Плтн_ПВХ Двухфиленчатое_!'
outlist = []

# Разместите код под этой строкой
for name in names:
	if stl in name and gl2 in name:
		outlist.append('П2лс')
	elif stl in name and gl1 in name:
		outlist.append('П1лс')
	elif stl in name and ost in name:
		outlist.append('П2лс')
	elif alm in name and gl2 in name:
		outlist.append('Г')
	elif alm in name and gl1 in name:
		outlist.append('Г')
	elif alm in name and ost in name:
		outlist.append('О')
	elif drv in name and gl2 in name:
		outlist.append('Г')
	elif pvh in name and gl2 in name:
		outlist.append('Г')
	elif pvh in name and dvfl in name:
		outlist.append('Г')
	else:
		outlist.append('#')
# Назначьте вывод переменной OUT.
OUT = outlist
# ----------------------------------------
# note: Для ФОП_Описание
python_script_8 = Python(IN[0]=formula_3)  # IronPython2
# ---------- python_script_8.python (42 lines) ----------
# Загрузить стандартную библиотеку Python и библиотеку DesignScript
import sys
import clr
clr.AddReference('ProtoGeometry')
from Autodesk.DesignScript.Geometry import *

# Введенные в этом узле данные сохраняется в виде списка в переменных IN.
names = IN[0]
stl = 'Сталь'
alm = 'Алюминий'
pvh = 'ПВХ'
drv = 'Дерево'
gl2 = 'Двр_Плтн_Глухое_!'
gl1 = 'Двр_Плтн_Глухое Однослойное_!'
ost = 'Двр_Плтн_Остекленное_!'
dvfl = 'Двр_Плтн_ПВХ Двухфиленчатое_!'
outlist = []

# Разместите код под этой строкой
for name in names:
	if stl in name and gl2 in name:
		outlist.append('с полотном из двух стальных листов, ')
	elif stl in name and gl1 in name:
		outlist.append('с полотном из одного стального листа, ')
	elif stl in name and ost in name:
		outlist.append('с полотном из двух стальных листов, ')
	elif alm in name and gl2 in name:
		outlist.append('глухой, ')
	elif alm in name and gl1 in name:
		outlist.append('глухой, ')
	elif alm in name and ost in name:
		outlist.append('остекленный ')
	elif drv in name and gl2 in name:
		outlist.append('глухой, ')
	elif pvh in name and gl2 in name:
		outlist.append('с глухим вариантом заполнения дверного полотна, ')
	elif pvh in name and dvfl in name:
		outlist.append('с глухим вариантом заполнения дверного полотна, ')
	else:
		outlist.append('ТИП ПОЛОТНА НЕ НАЙДЕН/')
# Назначьте вывод переменной OUT.
OUT = outlist
# ----------------------------------------

# group: Размеры
code_block_16 = CodeBlock { "Примерная высота"; }
getParameterValueByName_8 = Element.GetParameterValueByName(element=filterByBoolMask_4.in, parameterName=code_block_16)
string_from_object = FromObject(object=getParameterValueByName_8)
code_block_17 = CodeBlock { ",000000"; }
code_block_18 = CodeBlock { ""; }
replace = String.Replace(string=string_from_object, searchFor=code_block_17, replaceWith=code_block_18)
code_block_19 = CodeBlock { "Примерная ширина"; }
getParameterValueByName_9 = Element.GetParameterValueByName(element=filterByBoolMask_4.in, parameterName=code_block_19)
string_from_object_2 = FromObject(object=getParameterValueByName_9)
code_block_20 = CodeBlock { ",000000"; }
code_block_21 = CodeBlock { ""; }
replace_2 = String.Replace(string=string_from_object_2, searchFor=code_block_20, replaceWith=code_block_21)
# note: Для ФОП_Наименование
code_block_22 = CodeBlock(a=replace, b=replace_2) { a+"х"+b; }
# note: Для ФОП_Описание
code_block_23 = CodeBlock(a=replace) { "высотой "+a+" мм, "; }
code_block_24 = CodeBlock(a=replace_2) { "шириной "+a+" мм."; }

# group: ГОСТ
python_script_9 = Python(IN[0]=getParameterValueByName_4)  # IronPython2
# ---------- python_script_9.python (33 lines) ----------
# Загрузить стандартную библиотеку Python и библиотеку DesignScript
import sys
import clr
clr.AddReference('ProtoGeometry')
from Autodesk.DesignScript.Geometry import *

# Введенные в этом узле данные сохраняется в виде списка в переменных IN.
names = IN[0]
pp = 'ПП'
stl = 'Сталь'
alm = 'Алюминий'
pvh = 'ПВХ'
drv = 'Дерево'
outlist = []

# Разместите код под этой строкой
for name in names:
	if stl in name and not pp in name:
		outlist.append('ГОСТ 31173-2016')
	elif stl in name and pp in name:
		outlist.append('ГОСТ Р 57327-2016')
	elif alm in name and not pp in name:
		outlist.append('ГОСТ 23747-2015')
	elif alm in name and pp in name:
		outlist.append('ГОСТ 23747-2015')
	elif drv in name:
		outlist.append('ГОСТ 475-2016')
	elif pvh in name:
		outlist.append('ГОСТ 30970-2014')
	else:
		outlist.append('ГОСТ НЕ НАЙДЕН')
# Назначьте вывод переменной OUT.
OUT = outlist
# ----------------------------------------

# group: Остекление
code_block_25 = CodeBlock { "Двр_Двр_Однп"; }
eq_4 = getParameterValueByName_5 == code_block_25
code_block_26 = CodeBlock { "Примерная ширина"; }
code_block_27 = CodeBlock { "Расч ОснПолотно Ширина"; }
formula_4 = Formula("if(a=true,b,c)", a=eq_4, b=code_block_26, c=code_block_27)
getParameterValueByName_10 = Element.GetParameterValueByName(element=filterByBoolMask_4.in, parameterName=formula_4)
code_block_28 = CodeBlock { "Полотно Рамка Слева"; }
getParameterValueByName_11 = Element.GetParameterValueByName(element=filterByBoolMask_4.in, parameterName=code_block_28)
code_block_29 = CodeBlock { "Полотно Рамка Справа"; }
getParameterValueByName_12 = Element.GetParameterValueByName(element=filterByBoolMask_4.in, parameterName=code_block_29)
code_block_30 = CodeBlock { "Примерная высота"; }
getParameterValueByName_13 = Element.GetParameterValueByName(element=filterByBoolMask_4.in, parameterName=code_block_30)
code_block_31 = CodeBlock { "Полотно Рамка Сверху"; }
getParameterValueByName_14 = Element.GetParameterValueByName(element=filterByBoolMask_4.in, parameterName=code_block_31)
code_block_32 = CodeBlock { "Полотно Рамка Снизу"; }
getParameterValueByName_15 = Element.GetParameterValueByName(element=filterByBoolMask_4.in, parameterName=code_block_32)
formula_5 = Formula("((a-b-c)*(d-f-g))/1000000", a=getParameterValueByName_10, b=getParameterValueByName_11, c=getParameterValueByName_12, d=getParameterValueByName_13, f=getParameterValueByName_14, g=getParameterValueByName_15)
# note: Для ФОП_Наименование
python_script_10 = Python(IN[0]=formula_3, IN[1]=formula_5)  # IronPython2
# ---------- python_script_10.python (26 lines) ----------
# Загрузить стандартную библиотеку Python и библиотеку DesignScript
import sys
import clr
clr.AddReference('ProtoGeometry')
from Autodesk.DesignScript.Geometry import *

# Введенные в этом узле данные сохраняется в виде списка в переменных IN.
names = IN[0]
glars = IN[1]
stl = 'Сталь'
alm = 'Алюминий'
ost = 'Двр_Плтн_Остекленное_!'
outlist = []

# Разместите код под этой строкой
for name, glar in zip(names, glars):
	if ost in name and glar >= 1.2 and (stl in name or alm in name):
		outlist.append('О (≥1.2 м²)')
	elif ost in name and glar >= 0.2 and glar < 1.2 and (stl in name or alm in name):
		outlist.append('О (≥0.2 м²)')
	elif ost in name and glar < 0.2 and (stl in name or alm in name):
		outlist.append('О (? м²)')
	else:
		outlist.append('')
# Назначьте вывод переменной OUT.
OUT = outlist
# ----------------------------------------
# note: Для ФОП_Описание
python_script_11 = Python(IN[0]=formula_3, IN[1]=formula_5, IN[2]=getParameterValueByName_4)  # IronPython2
# ---------- python_script_11.python (35 lines) ----------
# Загрузить стандартную библиотеку Python и библиотеку DesignScript
import sys
import clr
clr.AddReference('ProtoGeometry')
from Autodesk.DesignScript.Geometry import *

# Введенные в этом узле данные сохраняется в виде списка в переменных IN.
names = IN[0]
glars = IN[1]
mats = IN[2]
stl = 'Сталь'
alm = 'Алюминий'
ost = 'Двр_Плтн_Остекленное_!'
outlist = []

# Разместите код под этой строкой
for name, glar, mat in zip(names, glars, mats):
	if ost in name and glar >= 1.2 and stl in mat:
		outlist.append('остекленный (более 1.2 м²), ')
	elif ost in name and glar >= 0.2 and glar < 1.2 and stl in mat:
		outlist.append('остекленный (более 0.2 м²), ')
	elif ost in name and glar < 0.2 and stl in mat:
		outlist.append('остекленный (менее 0.2 м²), ')
	elif ost in name and glar >= 1.2 and alm in mat:
		outlist.append('(более 1.2 м²), ')
	elif ost in name and glar >= 0.2 and glar < 1.2 and alm in mat:
		outlist.append('(более 0.2 м²), ')
	elif ost in name and glar < 0.2 and alm in mat:
		outlist.append('(менее 0.2 м²), ')
	elif ost in name and not stl in mat and not alm in mat:
		outlist.append('ОСТЕКЛЕНИЕ НЕ ОПРЕДЕЛЕНО/')
	else:
		outlist.append('')
# Назначьте вывод переменной OUT.
OUT = outlist
# ----------------------------------------

# group: Огнестойкость
code_block_33 = CodeBlock { "ФОП_Огнестойкость"; }
getParameterValueByName_16 = Element.GetParameterValueByName(element=filterByBoolMask_4.in, parameterName=code_block_33)
code_block_34 = CodeBlock { "-"; }
code_block_35 = CodeBlock { ""; }
# note: Для ФОП_Наименование
formula_6 = Formula("if(a=b,c,a)", a=getParameterValueByName_16, b=code_block_34, c=code_block_35)
code_block_36 = CodeBlock { "Противопожарная"; }
getParameterValueByName_17 = Element.GetParameterValueByName(element=filterByBoolMask_4.in, parameterName=code_block_36)
string_from_object_3 = FromObject(object=getParameterValueByName_17)
# note: Для ФОП_Описание
python_script_12 = Python(IN[0]=string_from_object_3, IN[1]=formula_6, IN[2]=getParameterValueByName_4)  # IronPython2
# ---------- python_script_12.python (28 lines) ----------
# Загрузить стандартную библиотеку Python и библиотеку DesignScript
import sys
import clr
clr.AddReference('ProtoGeometry')
from Autodesk.DesignScript.Geometry import *

# Введенные в этом узле данные сохраняется в виде списка в переменных IN.
names = IN[0]
fires = IN[1]
types = IN[2]
stl = 'Сталь'
alm = 'Алюминий'
outlist = []

# Разместите код под этой строкой
for name, fire , type in zip(names, fires, types):
	if name == '1' and 'EI' in fire and not 'W' in fire and not 'WS' in fire and not 'S' in fire and (stl in type or alm in type):
		outlist.append('с пределом огнестойкости ' + fire + ', ')
	elif name == '1' and 'EI' in fire and 'W' in fire and (stl in type or alm in type):
		outlist.append('с пределом огнестойкости ' + fire + ', в дымогазонепроницаемом исполнении, ')
	elif name == '1' and 'EI' in fire and 'S' in fire and (stl in type or alm in type):
		outlist.append('с пределом огнестойкости ' + fire + ', в дымогазонепроницаемом исполнении, ')
	elif name == '1' and (not stl in name or not alm in name):
		outlist.append('ОГНЕСТОЙКОСТЬ НЕ ОПРЕДЕЛЕНА/')
	else:
		outlist.append('')
# Назначьте вывод переменной OUT.
OUT = outlist
# ----------------------------------------

# group: Доводчик
code_block_37 = CodeBlock { "Доводчик"; }
getParameterValueByName_18 = Element.GetParameterValueByName(element=filterByBoolMask_4.in, parameterName=code_block_37)
# note: Для ФОП_Наименование
python_script_13 = Python(IN[0]=getParameterValueByName_18)  # IronPython2
# ---------- python_script_13.python (18 lines) ----------
# Загрузить стандартную библиотеку Python и библиотеку DesignScript
import sys
import clr
clr.AddReference('ProtoGeometry')
from Autodesk.DesignScript.Geometry import *

# Введенные в этом узле данные сохраняется в виде списка в переменных IN.
names = IN[0]
outlist = []

# Разместите код под этой строкой
for name in names:
	if name == 1:
		outlist.append('Дд')
	else:
		outlist.append('')
# Назначьте вывод переменной OUT.
OUT = outlist
# ----------------------------------------
# note: Для ФОП_Описание
python_script_14 = Python(IN[0]=getParameterValueByName_18)  # IronPython2
# ---------- python_script_14.python (18 lines) ----------
# Загрузить стандартную библиотеку Python и библиотеку DesignScript
import sys
import clr
clr.AddReference('ProtoGeometry')
from Autodesk.DesignScript.Geometry import *

# Введенные в этом узле данные сохраняется в виде списка в переменных IN.
names = IN[0]
outlist = []

# Разместите код под этой строкой
for name in names:
	if name == 1:
		outlist.append(' Оборудовать устройствами самозакрывания (доводчиками) с усилием при открывании не более 19.5 Н⋅м.')
	else:
		outlist.append('')
# Назначьте вывод переменной OUT.
OUT = outlist
# ----------------------------------------

# group: Антипаника
# note: Для ФОП_Наименование
python_script_15 = Python(IN[0]=getParameterValueByName_4)  # IronPython2
# ---------- python_script_15.python (20 lines) ----------
# Загрузить стандартную библиотеку Python и библиотеку DesignScript
import sys
import clr
clr.AddReference('ProtoGeometry')
from Autodesk.DesignScript.Geometry import *

# Введенные в этом узле данные сохраняется в виде списка в переменных IN.
names = IN[0]
apn = 'Ан'
apsh = 'Аш'
outlist = []

# Разместите код под этой строкой
for name in names:
	if apn in name or apsh in name:
		outlist.append('Ап')
	else:
		outlist.append('')
# Назначьте вывод переменной OUT.
OUT = outlist
# ----------------------------------------
# note: Для ФОП_Описание
python_script_16 = Python(IN[0]=getParameterValueByName_4)  # IronPython2
# ---------- python_script_16.python (22 lines) ----------
# Загрузить стандартную библиотеку Python и библиотеку DesignScript
import sys
import clr
clr.AddReference('ProtoGeometry')
from Autodesk.DesignScript.Geometry import *

# Введенные в этом узле данные сохраняется в виде списка в переменных IN.
names = IN[0]
apn = 'Ан'
apsh = 'Аш'
outlist = []

# Разместите код под этой строкой
for name in names:
	if apn in name:
		outlist.append(' Оборудовать устройством экстренного открывания ("антипаника") нажимного типа.')
	elif apsh in name:
		outlist.append(' Оборудовать устройством экстренного открывания ("антипаника") типа пуш-бар (ручка-штанга).')
	else:
		outlist.append('')
# Назначьте вывод переменной OUT.
OUT = outlist
# ----------------------------------------

# group: Замок
code_block_38 = CodeBlock { "Замок"; }
getParameterValueByName_19 = Element.GetParameterValueByName(element=filterByBoolMask_4.in, parameterName=code_block_38)
# note: Для ФОП_Наименование
python_script_17 = Python(IN[0]=getParameterValueByName_19)  # IronPython2
# ---------- python_script_17.python (18 lines) ----------
# Загрузить стандартную библиотеку Python и библиотеку DesignScript
import sys
import clr
clr.AddReference('ProtoGeometry')
from Autodesk.DesignScript.Geometry import *

# Введенные в этом узле данные сохраняется в виде списка в переменных IN.
names = IN[0]
outlist = []

# Разместите код под этой строкой
for name in names:
	if name == 1:
		outlist.append('Мз')
	else:
		outlist.append('')
# Назначьте вывод переменной OUT.
OUT = outlist
# ----------------------------------------
# note: Для ФОП_Описание
python_script_18 = Python(IN[0]=getParameterValueByName_19)  # IronPython2
# ---------- python_script_18.python (18 lines) ----------
# Загрузить стандартную библиотеку Python и библиотеку DesignScript
import sys
import clr
clr.AddReference('ProtoGeometry')
from Autodesk.DesignScript.Geometry import *

# Введенные в этом узле данные сохраняется в виде списка в переменных IN.
names = IN[0]
outlist = []

# Разместите код под этой строкой
for name in names:
	if name == 1:
		outlist.append(' Оборудовать запирающими устройствами.')
	else:
		outlist.append('')
# Назначьте вывод переменной OUT.
OUT = outlist
# ----------------------------------------

# group: Сталь Для ФОП_Наименование
code_block_39 = CodeBlock(a=python_script, b=python_script_3, c=python_script_5, d=python_script_7, y=code_block_22, z=python_script_9, x=python_script_10, e=formula_6, f=python_script_13, g=python_script_15, h=python_script_17) { a+" "+b+" "+c+" "+d+" М3 "+y+" - "+z+" - "+x+" "+e+" "+f+" "+g+" "+h; }
code_block_40 = CodeBlock { "   "; }
code_block_41 = CodeBlock { "  "; }
replace_3 = String.Replace(string=code_block_39, searchFor=code_block_40, replaceWith=code_block_41)
code_block_42 = CodeBlock { " "; }
replace_4 = String.Replace(string=replace_3, searchFor=code_block_41, replaceWith=code_block_42)

# group: ПВХ Для ФОП_Наименование
code_block_43 = CodeBlock(a=python_script, b=python_script_7, c=python_script_5, d=python_script_3, y=code_block_22, z=python_script_9, e=python_script_13, f=python_script_15, g=python_script_17) { a+" "+b+" "+c+" "+d+" Р "+" М3 "+y+" - "+z+" - "+e+" "+f+" "+g; }
code_block_44 = CodeBlock { "   "; }
code_block_45 = CodeBlock { "  "; }
replace_5 = String.Replace(string=code_block_43, searchFor=code_block_44, replaceWith=code_block_45)
code_block_46 = CodeBlock { " "; }
replace_6 = String.Replace(string=replace_5, searchFor=code_block_45, replaceWith=code_block_46)

# group: Дерево Для ФОП_Наименование
code_block_47 = CodeBlock(a=python_script, b=python_script_3, c=python_script_7, d=python_script_5, y=code_block_22, z=python_script_9, e=python_script_13, f=python_script_15, g=python_script_17) { a+" Рсп "+b+" "+c+" "+d+" Мд3 "+y+" - "+z+" - "+e+" "+f+" "+g; }
code_block_48 = CodeBlock { "   "; }
code_block_49 = CodeBlock { "  "; }
replace_7 = String.Replace(string=code_block_47, searchFor=code_block_48, replaceWith=code_block_49)
code_block_50 = CodeBlock { " "; }
replace_8 = String.Replace(string=replace_7, searchFor=code_block_49, replaceWith=code_block_50)

# group: Алюминий Для ФОП_Наименование
code_block_51 = CodeBlock(a=python_script, b=python_script_7, c=python_script_5, d=python_script_3, y=code_block_22, z=python_script_9, x=python_script_10, e=formula_6, f=python_script_13, g=python_script_15, h=python_script_17) { a+" "+b+" "+c+" "+d+" Р "+" М3 "+y+" - "+z+" - "+x+" "+e+" "+f+" "+g+" "+h; }
code_block_52 = CodeBlock { "   "; }
code_block_53 = CodeBlock { "  "; }
replace_9 = String.Replace(string=code_block_51, searchFor=code_block_52, replaceWith=code_block_53)
code_block_54 = CodeBlock { " "; }
replace_10 = String.Replace(string=replace_9, searchFor=code_block_53, replaceWith=code_block_54)

# group: ФОП_Наименование
code_block_55 = CodeBlock { "ФОП_Наименование"; }
python_script_19 = Python(IN[0]=getParameterValueByName_4)  # IronPython2
# ---------- python_script_19.python (28 lines) ----------
# Загрузить стандартную библиотеку Python и библиотеку DesignScript
import sys
import clr
clr.AddReference('ProtoGeometry')
from Autodesk.DesignScript.Geometry import *

# Введенные в этом узле данные сохраняется в виде списка в переменных IN.
names = IN[0]
stl = 'Сталь'
alm = 'Алюминий'
pvh = 'ПВХ'
drv = 'Дерево'
outlist = []

# Разместите код под этой строкой
for name in names:
	if stl in name:
		outlist.append('Сталь')
	elif alm in name:
		outlist.append('Алюминий')
	elif drv in name:
		outlist.append('Дерево')
	elif pvh in name:
		outlist.append('ПВХ')
	else:
		outlist.append('Материал не найден')
# Назначьте вывод переменной OUT.
OUT = outlist
# ----------------------------------------
code_block_56 = CodeBlock { "Сталь"; }
code_block_57 = CodeBlock { "ПВХ"; }
code_block_58 = CodeBlock { "Дерево"; }
code_block_59 = CodeBlock { "Алюминий"; }
code_block_60 = CodeBlock { "Марка по ГОСТ не найдена"; }
formula_7 = Formula("if(a=b,w,if(a=c,x,if(a=d,y,if(a=e,z,i))))", a=python_script_19, b=code_block_56, w=replace_4, c=code_block_57, x=replace_6, d=code_block_58, y=replace_8, e=code_block_59, z=replace_10, i=code_block_60)
setParameterByName = Element.SetParameterByName(element=filterByBoolMask_4.in, parameterName=code_block_55, value=formula_7)

# group: ФОП_Обозначение
code_block_61 = CodeBlock { "ФОП_Обозначение"; }
setParameterByName_2 = Element.SetParameterByName(element=filterByBoolMask_4.in, parameterName=code_block_61, value=python_script_9)

# group: Изоляция
python_script_20 = Python(IN[0]=getParameterValueByName_4)  # IronPython2
# ---------- python_script_20.python (19 lines) ----------
# Загрузить стандартную библиотеку Python и библиотеку DesignScript
import sys
import clr
clr.AddReference('ProtoGeometry')
from Autodesk.DesignScript.Geometry import *

# Введенные в этом узле данные сохраняется в виде списка в переменных IN.
names = IN[0]
ut = 'Ут'
outlist = []

# Разместите код под этой строкой
for name in names:
	if ut in name:
		outlist.append('утепленный, ')
	else:
		outlist.append('')
# Назначьте вывод переменной OUT.
OUT = outlist
# ----------------------------------------

# group: Сталь Для ФОП_Описание
code_block_62 = CodeBlock(a=python_script_2, b=python_script_12, c=python_script_4, d=python_script_6, e=python_script_8, ut=python_script_20, f=python_script_11, g=code_block_23, h=code_block_24, i=python_script_14, j=python_script_16, k=python_script_18) { a+b+c+d+e+ut+f+"класса прочности М3, "+g+h+i+j+k; }
code_block_63 = CodeBlock { "   "; }
code_block_64 = CodeBlock { "  "; }
replace_11 = String.Replace(string=code_block_62, searchFor=code_block_63, replaceWith=code_block_64)
code_block_65 = CodeBlock { " "; }
replace_12 = String.Replace(string=replace_11, searchFor=code_block_64, replaceWith=code_block_65)

# group: ПВХ Для ФОП_Описание
code_block_66 = CodeBlock(a=python_script_2, b=python_script_8, ut=python_script_20, c=python_script_6, d=python_script_4, e=code_block_23, f=code_block_24, g=python_script_14, h=python_script_16, i=python_script_18) { a+b+ut+c+d+"распашной, "+"класса прочности М3, "+e+f+g+h+i; }
code_block_67 = CodeBlock { "   "; }
code_block_68 = CodeBlock { "  "; }
replace_13 = String.Replace(string=code_block_66, searchFor=code_block_67, replaceWith=code_block_68)
code_block_69 = CodeBlock { " "; }
replace_14 = String.Replace(string=replace_13, searchFor=code_block_68, replaceWith=code_block_69)

# group: Дерево Для ФОП_Описание
code_block_70 = CodeBlock(a=python_script_2, b=python_script_4, c=python_script_8, ut=python_script_20, d=python_script_6, e=code_block_23, f=code_block_24, g=python_script_14, h=python_script_16, i=python_script_18) { a+b+"распашной, "+c+ut+d+"класса прочности Мд3, "+e+f+g+h+i; }
code_block_71 = CodeBlock { "   "; }
code_block_72 = CodeBlock { "  "; }
replace_15 = String.Replace(string=code_block_70, searchFor=code_block_71, replaceWith=code_block_72)
code_block_73 = CodeBlock { " "; }
replace_16 = String.Replace(string=replace_15, searchFor=code_block_72, replaceWith=code_block_73)

# group: Алюминий Для ФОП_Описание
code_block_74 = CodeBlock(a=python_script_2, b=python_script_12, c=python_script_8, ut=python_script_20, d=python_script_11, e=python_script_4, f=python_script_6, g=code_block_23, h=code_block_24, i=python_script_14, j=python_script_16, k=python_script_18) { a+b+c+ut+d+e+f+"распашной, "+"класса прочности М3, "+g+h+i+j+k; }
code_block_75 = CodeBlock { "   "; }
code_block_76 = CodeBlock { "  "; }
replace_17 = String.Replace(string=code_block_74, searchFor=code_block_75, replaceWith=code_block_76)
code_block_77 = CodeBlock { " "; }
replace_18 = String.Replace(string=replace_17, searchFor=code_block_76, replaceWith=code_block_77)

# group: ФОП_Описание
code_block_78 = CodeBlock { "ФОП_Описание"; }
python_script_21 = Python(IN[0]=getParameterValueByName_4)  # IronPython2; same code as python_script_19
code_block_79 = CodeBlock { "Сталь"; }
code_block_80 = CodeBlock { "ПВХ"; }
code_block_81 = CodeBlock { "Дерево"; }
code_block_82 = CodeBlock { "Алюминий"; }
code_block_83 = CodeBlock { "Марка по ГОСТ не найдена"; }
formula_8 = Formula("if(a=b,w,if(a=c,x,if(a=d,y,if(a=e,z,i))))", a=python_script_21, b=code_block_79, w=replace_12, c=code_block_80, x=replace_14, d=code_block_81, y=replace_16, e=code_block_82, z=replace_18, i=code_block_83)
setParameterByName_3 = Element.SetParameterByName(element=filterByBoolMask_4.in, parameterName=code_block_78, value=formula_8)

# group: Для разработчика
# note: ЗАДАЧИ ПО СКРИПТУ:
# 1.
# ОШИБКИ СКРИПТА:
# 1.
# ДОПОЛНИТЕЛЬНОЕ ОПИСАНИЕ:
# 1.
python_script_22 = Python()  # IronPython2
# ---------- python_script_22.python (13 lines) ----------
import codecs
import os.path

path = r"T:\Проектный институт\Отдел стандартизации BIM и RD\BIM-Ресурсы\4-Dynamo\Архив\BIM-отдел\Dynamo_new_report.py"

result = ""

if os.path.exists(path):
	with codecs.open(path, 'r', encoding="utf-8") as file:
		for line in file.readlines():
			result += line

OUT = result
# ----------------------------------------
python_script_from_string = PythonStringNode(script=python_script_22)  # IronPython2
