# Dynamo graph script.dyn "Двери - Открывание_" (Dynamo 2.12.0.5650)

# group: ОПИСАНИЕ! ПРОЧИТАТЬ ПЕРЕД ЗАПУСКОМ!
# note: Скрипт "Двери - Открывание"
# Версия 1.1
# Разработал: Антипин М.
# ЧТО ДЕЛАЕТ:
# Текст.
# КАК ПОЛЬЗОВАТЬСЯ:
# -Текст;

# group: ИСХОДНЫЕ ДАННЫЕ
code_block = CodeBlock { "Двери"; }
# note: Категория (двери по умолчанию)
code_block_2 = CodeBlock { "ФОП_Открывание По умолчанию"; }
code_block_3 = CodeBlock { "ФОП_Открывание"; }
code_block_4 = CodeBlock { "ФОП_Открывание Полное"; }
# note: Параметр для фильтрации
code_block_5 = CodeBlock { "ФОП_Зеркальный элемент"; }
# note: Параметры для назначения итоговых значений
code_block_6 = CodeBlock { "ФОП_Открывание ГОСТ"; }

byName = Category.ByName(name=code_block)
all_elements_of_category = ElementsOfCategory(Category=byName)
python_script = Python(IN[0]=all_elements_of_category)  # IronPython2
# ---------- python_script.python (17 lines) ----------
import clr
clr.AddReference('RevitAPI')
from Autodesk.Revit.DB import *

clr.AddReference("RevitServices")
import RevitServices
from RevitServices.Persistence import DocumentManager

doc = DocumentManager.Instance.CurrentDBDocument
items = UnwrapElement(IN[0])
typelist = list()
for item in items:
	try: 
		typelist.append(doc.GetElement(item.GetTypeId()))
	except:
		typelist.append(list())
OUT = typelist
# ----------------------------------------
getParameterValueByName = Element.GetParameterValueByName(element=python_script, parameterName=code_block_2)
string_from_object = FromObject(obj=getParameterValueByName)
code_block_7 = CodeBlock { "-"; }
contains = String.Contains(string=string_from_object, searchFor=code_block_7)
filterByBoolMask = List.FilterByBoolMask(list=all_elements_of_category, mask=contains)

# group: Проверка на зеркальность
python_script_2 = Python(IN[0]=filterByBoolMask.out)  # IronPython2
# ---------- python_script_2.python (17 lines) ----------
import clr
clr.AddReference('RevitAPI')
from Autodesk.Revit.DB import Element

elements = UnwrapElement(IN[0]) if isinstance(IN[0],list) else [UnwrapElement(IN[0])]

mirroredElements,items = [],[]

for element in elements:
	if hasattr(element, "Mirrored"):
		if element.Mirrored is True:
			mirroredElements.append(element)
		else:
			items.append(element)
	else:items.append(element)
	
OUT = mirroredElements, items
# ----------------------------------------
code_block_8 = CodeBlock(x=python_script_2) { x[0]; x[1]; }

watch = Watch(code_block_3)
code_block_9 = CodeBlock { "Л"; ""; }
setParameterByName = Element.SetParameterByName(element=code_block_8.out0, parameterName=watch, value=code_block_9.out0)
setParameterByName_2 = Element.SetParameterByName(element=code_block_8.out1, parameterName=watch, value=code_block_9.out1)

# group: Назначение параметров 2
watch_2 = Watch(code_block_3)
code_block_10 = CodeBlock { ""; }
setParameterByName_3 = Element.SetParameterByName(element=filterByBoolMask.in, parameterName=watch_2, value=code_block_10)
watch_3 = Watch(code_block_4)
code_block_11 = CodeBlock { "Равнопольная"; }
setParameterByName_4 = Element.SetParameterByName(element=filterByBoolMask.in, parameterName=watch_3, value=code_block_11)
watch_4 = Watch(code_block_6)
code_block_12 = CodeBlock { "Р"; }
setParameterByName_5 = Element.SetParameterByName(element=filterByBoolMask.in, parameterName=watch_4, value=code_block_12)

# group: Назначение параметров 3
watch_5 = Watch(code_block_4)
code_block_13 = CodeBlock { "Левая"; "Правая"; }
setParameterByName_6 = Element.SetParameterByName(element=code_block_8.out0, parameterName=watch_5, value=code_block_13.out0)
setParameterByName_7 = Element.SetParameterByName(element=code_block_8.out1, parameterName=watch_5, value=code_block_13.out1)

uniqueItems = List.UniqueItems(list=python_script)

# group: Проверка на зеркальность
python_script_3 = Python(IN[0]=all_elements_of_category)  # IronPython2; same code as python_script_2
code_block_14 = CodeBlock(x=python_script_3) { x[0]; x[1]; }

# group: Назначение параметров 1
watch_6 = Watch(code_block_5)
code_block_15 = CodeBlock { "Да"; "Нет"; }
setParameterByName_8 = Element.SetParameterByName(element=code_block_14.out0, parameterName=watch_6, value=code_block_15.out0)
setParameterByName_9 = Element.SetParameterByName(element=code_block_14.out1, parameterName=watch_6, value=code_block_15.out1)

watch_7 = Watch(code_block_6)
code_block_16 = CodeBlock { "Л"; "Пр"; }
setParameterByName_10 = Element.SetParameterByName(element=code_block_8.out0, parameterName=watch_7, value=code_block_16.out0)
setParameterByName_11 = Element.SetParameterByName(element=code_block_8.out1, parameterName=watch_7, value=code_block_16.out1)

# group: Для разработчика
# note: ЗАДАЧИ ПО СКРИПТУ:
# 1. Текст;
# 2. Текст.
# ОШИБКИ СКРИПТА:
# 1. Текст.
# ДОПОЛНИТЕЛЬНОЕ ОПИСАНИЕ:
# 1. В скрипте используется следующая логика работы:
python_script_4 = Python()  # IronPython2
# ---------- python_script_4.python (13 lines) ----------
import codecs
import os.path

path = r"T:\Проектный институт\Отдел стандартизации BIM и RD\BIM-Ресурсы\4-Dynamo\Архив\BIM-отдел\Dynamo_new_report.py"

result = ""

if os.path.exists(path):
	with codecs.open(path, 'r', encoding="utf-8") as file:
		for line in file.readlines():
			result += line

OUT = result
# ----------------------------------------
python_script_from_string = PythonStringNode(script=python_script_4)  # IronPython2
