# Dynamo graph script.dyn "Окна - Открывание" (Dynamo 2.12.1.8246)

# group: ОПИСАНИЕ! ПРОЧИТАТЬ ПЕРЕД ЗАПУСКОМ!
# note: Скрипт "Шаблон скрипта"
# Версия 1.0
# Разработал:
# ЧТО ДЕЛАЕТ:
# Текст.
# КАК ПОЛЬЗОВАТЬСЯ:
# -Текст;

# group: Исходные данные
categories = Categories("OST_Windows")
all_elements_of_category = ElementsOfCategory(Category=categories)

# group: Фильтрация Окон и ББлоков
code_block = CodeBlock { "Семейство"; }
getParameterValueByName = Element.GetParameterValueByName(element=all_elements_of_category, parameterName=code_block)
string_from_object = FromObject(object=getParameterValueByName)
code_block_2 = CodeBlock { "Окн_Окн_"; }
contains = String.Contains(string=string_from_object, searchFor=code_block_2)
filterByBoolMask = List.FilterByBoolMask(list=all_elements_of_category, mask=contains)
code_block_3 = CodeBlock { "Окн_ББлок_"; }
contains_2 = String.Contains(string=string_from_object, searchFor=code_block_3)
filterByBoolMask_2 = List.FilterByBoolMask(list=all_elements_of_category, mask=contains_2)
join = List.Join(list0=filterByBoolMask.in, list1=filterByBoolMask_2.in)

python_script = Python(IN[0]=join)  # IronPython2
# ---------- python_script.python (17 lines) ----------
import clr
clr.AddReference('RevitAPI')
from Autodesk.Revit.DB import *

clr.AddReference("RevitServices")
import RevitServices
from RevitServices.Persistence import DocumentManager

doc = DocumentManager.Instance.CurrentDBDocument
items = UnwrapElement(IN[0])
typelist = list()
for item in items:
	try: 
		typelist.append(doc.GetElement(item.GetTypeId()))
	except:
		typelist.append(list())
OUT = typelist
# ----------------------------------------
code_block_4 = CodeBlock { "ФОП_Открывание По умолчанию"; }
getParameterValueByName_2 = Element.GetParameterValueByName(element=python_script, parameterName=code_block_4)
string_from_object_2 = FromObject(object=getParameterValueByName_2)
code_block_5 = CodeBlock { "-"; }
contains_3 = String.Contains(string=string_from_object_2, searchFor=code_block_5)
filterByBoolMask_3 = List.FilterByBoolMask(list=join, mask=contains_3)

# group: Проверка на зеркальность
python_script_2 = Python(IN[0]=filterByBoolMask_3.out)  # IronPython2
# ---------- python_script_2.python (17 lines) ----------
import clr
clr.AddReference('RevitAPI')
from Autodesk.Revit.DB import Element

elements = UnwrapElement(IN[0]) if isinstance(IN[0],list) else [UnwrapElement(IN[0])]

mirroredElements,items = [],[]

for element in elements:
	if hasattr(element, "Mirrored"):
		if element.Mirrored is True:
			mirroredElements.append(element)
		else:
			items.append(element)
	else:items.append(element)
	
OUT = mirroredElements, items
# ----------------------------------------
code_block_6 = CodeBlock(x=python_script_2) { x[0]; x[1]; }

code_block_7 = CodeBlock { "ФОП_Открывание Полное"; }
code_block_8 = CodeBlock { "Зеркальное"; }
setParameterByName = Element.SetParameterByName(element=code_block_6.out0, parameterName=code_block_7, value=code_block_8)
code_block_9 = CodeBlock { "ФОП_Открывание Полное"; }
code_block_10 = CodeBlock { "-"; }
setParameterByName_2 = Element.SetParameterByName(element=filterByBoolMask_3.in, parameterName=code_block_9, value=code_block_10)
code_block_11 = CodeBlock { "ФОП_Открывание Полное"; }
code_block_12 = CodeBlock { "-"; }
setParameterByName_3 = Element.SetParameterByName(element=code_block_6.out1, parameterName=code_block_11, value=code_block_12)

# group: Проверка на зеркальность
python_script_3 = Python(IN[0]=join)  # IronPython2; same code as python_script_2
code_block_13 = CodeBlock(x=python_script_3) { x[0]; x[1]; }

code_block_14 = CodeBlock { "ФОП_Зеркальный элемент"; }
code_block_15 = CodeBlock { "Да"; }
setParameterByName_4 = Element.SetParameterByName(element=code_block_13.out0, parameterName=code_block_14, value=code_block_15)
code_block_16 = CodeBlock { "ФОП_Зеркальный элемент"; }
code_block_17 = CodeBlock { "Нет"; }
setParameterByName_5 = Element.SetParameterByName(element=code_block_13.out1, parameterName=code_block_16, value=code_block_17)

# group: Для разработчика
# note: ЗАДАЧИ ПО СКРИПТУ:
# 1. Текст;
# 2. Текст.
# ОШИБКИ СКРИПТА:
# 1. Текст.
# ДОПОЛНИТЕЛЬНОЕ ОПИСАНИЕ:
# 1. В скрипте используется следующая логика работы:
python_script_4 = Python()  # IronPython2
# ---------- python_script_4.python (13 lines) ----------
import codecs
import os.path

path = r"T:\Проектный институт\Отдел стандартизации BIM и RD\BIM-Ресурсы\4-Dynamo\Архив\BIM-отдел\Dynamo_new_report.py"

result = ""

if os.path.exists(path):
	with codecs.open(path, 'r', encoding="utf-8") as file:
		for line in file.readlines():
			result += line

OUT = result
# ----------------------------------------
python_script_from_string = PythonStringNode(script=python_script_4)  # IronPython2

code_block_18 = CodeBlock { "ФОП_Открывание"; }
elementType = Element.ElementType(element=code_block_6.out1)
string_from_object_3 = FromObject(object=elementType)
code_block_19 = CodeBlock { "Клапаны"; }
getParameterValueByName_3 = Element.GetParameterValueByName(element=code_block_6.out1, parameterName=code_block_19)
code_block_20 = CodeBlock { "Клапаны с фрезеровкой"; }
getParameterValueByName_4 = Element.GetParameterValueByName(element=code_block_6.out1, parameterName=code_block_20)
python_script_5 = Python(IN[0]=string_from_object_3, IN[1]=getParameterValueByName_3, IN[2]=getParameterValueByName_4)  # IronPython2
# ---------- python_script_5.python (94 lines) ----------
# Загрузить стандартную библиотеку Python и библиотеку DesignScript
import sys
import clr
clr.AddReference('ProtoGeometry')
from Autodesk.DesignScript.Geometry import *

# Введенные в этом узле данные сохраняется в виде списка в переменных IN.
families = IN[0]
clapans = IN[1]
clapansf = IN[2]
ok = 'Окн_Окн_'
bb = 'Окн_ББлок_'
outlist = []

# Разместите код под этой строкой
for family, clapan, clapanf in zip(families, clapans, clapansf):
	if ok in family:
		if clapan == 0 and clapanf == 0:
			outlist.append('')
		elif clapan == 0 and clapanf == 1:
			outlist.append('-к1ф')
		elif clapan == 0 and clapanf == 2:
			outlist.append('-к2ф')
		elif clapan == 1 and clapanf == 0:
			outlist.append('-к1')
		elif clapan == 2 and clapanf == 0:
			outlist.append('-к2')
		elif clapan == 1 and clapanf == 1:
			outlist.append('-к1ф')
		elif clapan == 2 and clapanf == 1:
			outlist.append('-к2ф1')
		elif clapan == 2 and clapanf == 2:
			outlist.append('-к2ф')
		elif clapan == 1 and len(str(clapanf)) == 0:
			outlist.append('-к1')
		elif clapan == 2 and len(str(clapanf)) == 0:
			outlist.append('-к2')
		elif len(str(clapan)) == 0 and len(str(clapanf)) == 0:
			outlist.append('')
		elif clapan == 0 and len(str(clapanf)) == 0:
			outlist.append('')
		elif clapan == 1 and len(str(clapanf)) == 0:
			outlist.append('-к1')
		elif clapan == 2 and len(str(clapanf)) == 0:
			outlist.append('-к2')
		elif len(str(clapan)) == 0 and clapanf == 0:
			outlist.append('')
		elif len(str(clapan)) == 0 and clapanf == 1:
			outlist.append('-к1ф')
		elif len(str(clapan)) == 0 and clapanf == 2:
			outlist.append('-к2ф')
		else:
			outlist.append('')
	elif bb in family:
		if clapan == 0 and clapanf == 0:
			outlist.append('Л')
		elif clapan == 0 and clapanf == 1:
			outlist.append('Л-к1ф')
		elif clapan == 0 and clapanf == 2:
			outlist.append('Л-к2ф')
		elif clapan == 1 and clapanf == 0:
			outlist.append('Л-к1')
		elif clapan == 2 and clapanf == 0:
			outlist.append('Л-к2')
		elif clapan == 1 and clapanf == 1:
			outlist.append('Л-к1ф')
		elif clapan == 2 and clapanf == 1:
			outlist.append('Л-к2ф1')
		elif clapan == 2 and clapanf == 2:
			outlist.append('Л-к2ф')
		elif clapan == 1 and len(str(clapanf)) == 0:
			outlist.append('Л-к1')
		elif clapan == 2 and len(str(clapanf)) == 0:
			outlist.append('Л-к2')
		elif len(str(clapan)) == 0 and len(str(clapanf)) == 0:
			outlist.append('Л')
		elif clapan == 0 and len(str(clapanf)) == 0:
			outlist.append('Л')
		elif clapan == 1 and len(str(clapanf)) == 0:
			outlist.append('Л-к1')
		elif clapan == 2 and len(str(clapanf)) == 0:
			outlist.append('Л-к2')
		elif len(str(clapan)) == 0 and clapanf == 0:
			outlist.append('Л')
		elif len(str(clapan)) == 0 and clapanf == 1:
			outlist.append('Л-к1ф')
		elif len(str(clapan)) == 0 and clapanf == 2:
			outlist.append('Л-к2ф')
		else:
			outlist.append('Л')
	else:
		outlist.append('')
# Назначьте вывод переменной OUT.
OUT = outlist
# ----------------------------------------
setParameterByName_6 = Element.SetParameterByName(element=code_block_6.out1, parameterName=code_block_18, value=python_script_5)
истина_фоп_примечание_ложь = BoolSelector(true)  # "ИСТИНА - ФОП_Примечание; ЛОЖЬ - Примечание"; graph input
code_block_21 = CodeBlock { "ФОП_Примечание"; }
code_block_22 = CodeBlock { "Примечание"; }
if_ = RefactoredIf(test=истина_фоп_примечание_ложь, true=code_block_21, false=code_block_22)
python_script_6 = Python(IN[0]=getParameterValueByName_3, IN[1]=getParameterValueByName_4)  # IronPython2
# ---------- python_script_6.python (51 lines) ----------
# Загрузить стандартную библиотеку Python и библиотеку DesignScript
import sys
import clr
clr.AddReference('ProtoGeometry')
from Autodesk.DesignScript.Geometry import *

# Введенные в этом узле данные сохраняется в виде списка в переменных IN.
clapans = IN[0]
clapansf = IN[1]
outlist = []

# Разместите код под этой строкой
for clapan, clapanf in zip(clapans, clapansf):
	if clapan == 0 and clapanf == 0:
		outlist.append('')
	elif clapan == 0 and clapanf == 1:
		outlist.append('к1ф - один клапан Air-Box Comfort S (с фрезеровкой)')
	elif clapan == 0 and clapanf == 2:
		outlist.append('к2ф - два клапана Air-Box Comfort S (с фрезеровкой)')
	elif clapan == 1 and clapanf == 0:
		outlist.append('к1 - один клапан Air-Box Comfort')
	elif clapan == 2 and clapanf == 0:
		outlist.append('к2 - два клапана Air-Box Comfort')
	elif clapan == 1 and clapanf == 1:
		outlist.append('к1ф - один клапан Air-Box Comfort S (с фрезеровкой)')
	elif clapan == 2 and clapanf == 1:
		outlist.append('к2ф1 - два клапана Air-Box Comfort, один с фрезеровкой (Air-Box Comfort S)')
	elif clapan == 2 and clapanf == 2:
		outlist.append('к2ф - два клапана Air-Box Comfort S (с фрезеровкой)')
	elif clapan == 1 and len(str(clapanf)) == 0:
		outlist.append('к1 - один клапан Air-Box Comfort')
	elif clapan == 2 and len(str(clapanf)) == 0:
		outlist.append('к2 - два клапана Air-Box Comfort')
	elif len(str(clapan)) == 0 and len(str(clapanf)) == 0:
		outlist.append('')
	elif clapan == 0 and len(str(clapanf)) == 0:
		outlist.append('')
	elif clapan == 1 and len(str(clapanf)) == 0:
		outlist.append('к1 - один клапан Air-Box Comfort')
	elif clapan == 2 and len(str(clapanf)) == 0:
		outlist.append('к2 - два клапана Air-Box Comfort')
	elif len(str(clapan)) == 0 and clapanf == 0:
		outlist.append('')
	elif len(str(clapan)) == 0 and clapanf == 1:
		outlist.append('к1ф - один клапан Air-Box Comfort S (с фрезеровкой)')
	elif len(str(clapan)) == 0 and clapanf == 2:
		outlist.append('к2ф - два клапана Air-Box Comfort S (с фрезеровкой)')
	else:
		outlist.append('НЕТ ДАННЫХ')
# Назначьте вывод переменной OUT.
OUT = outlist
# ----------------------------------------
setParameterByName_7 = Element.SetParameterByName(element=code_block_6.out1, parameterName=if_, value=python_script_6)
code_block_23 = CodeBlock { "ФОП_Открывание"; }
elementType_2 = Element.ElementType(element=code_block_6.out0)
string_from_object_4 = FromObject(object=elementType_2)
code_block_24 = CodeBlock { "Клапаны"; }
getParameterValueByName_5 = Element.GetParameterValueByName(element=code_block_6.out0, parameterName=code_block_24)
code_block_25 = CodeBlock { "Клапаны с фрезеровкой"; }
getParameterValueByName_6 = Element.GetParameterValueByName(element=code_block_6.out0, parameterName=code_block_25)
python_script_7 = Python(IN[0]=string_from_object_4, IN[1]=getParameterValueByName_5, IN[2]=getParameterValueByName_6)  # IronPython2
# ---------- python_script_7.python (94 lines) ----------
# Загрузить стандартную библиотеку Python и библиотеку DesignScript
import sys
import clr
clr.AddReference('ProtoGeometry')
from Autodesk.DesignScript.Geometry import *

# Введенные в этом узле данные сохраняется в виде списка в переменных IN.
families = IN[0]
clapans = IN[1]
clapansf = IN[2]
ok = 'Окн_Окн_'
bb = 'Окн_ББлок_'
outlist = []

# Разместите код под этой строкой
for family, clapan, clapanf in zip(families, clapans, clapansf):
	if ok in family:
		if clapan == 0 and clapanf == 0:
			outlist.append('.1')
		elif clapan == 0 and clapanf == 1:
			outlist.append('.1-к1ф')
		elif clapan == 0 and clapanf == 2:
			outlist.append('.1-к2ф')
		elif clapan == 1 and clapanf == 0:
			outlist.append('.1-к1')
		elif clapan == 2 and clapanf == 0:
			outlist.append('.1-к2')
		elif clapan == 1 and clapanf == 1:
			outlist.append('.1-к1ф')
		elif clapan == 2 and clapanf == 1:
			outlist.append('.1-к2ф1')
		elif clapan == 2 and clapanf == 2:
			outlist.append('.1-к2ф')
		elif clapan == 1 and len(str(clapanf)) == 0:
			outlist.append('.1-к1')
		elif clapan == 2 and len(str(clapanf)) == 0:
			outlist.append('.1-к2')
		elif len(str(clapan)) == 0 and len(str(clapanf)) == 0:
			outlist.append('.1')
		elif clapan == 0 and len(str(clapanf)) == 0:
			outlist.append('.1')
		elif clapan == 1 and len(str(clapanf)) == 0:
			outlist.append('.1-к1')
		elif clapan == 2 and len(str(clapanf)) == 0:
			outlist.append('.1-к2')
		elif len(str(clapan)) == 0 and clapanf == 0:
			outlist.append('.1')
		elif len(str(clapan)) == 0 and clapanf == 1:
			outlist.append('.1-к1ф')
		elif len(str(clapan)) == 0 and clapanf == 2:
			outlist.append('.1-к2ф')
		else:
			outlist.append('.1')
	elif bb in family:
		if clapan == 0 and clapanf == 0:
			outlist.append('')
		elif clapan == 0 and clapanf == 1:
			outlist.append('-к1ф')
		elif clapan == 0 and clapanf == 2:
			outlist.append('-к2ф')
		elif clapan == 1 and clapanf == 0:
			outlist.append('-к1')
		elif clapan == 2 and clapanf == 0:
			outlist.append('-к2')
		elif clapan == 1 and clapanf == 1:
			outlist.append('-к1ф')
		elif clapan == 2 and clapanf == 1:
			outlist.append('-к2ф1')
		elif clapan == 2 and clapanf == 2:
			outlist.append('-к2ф')
		elif clapan == 1 and len(str(clapanf)) == 0:
			outlist.append('-к1')
		elif clapan == 2 and len(str(clapanf)) == 0:
			outlist.append('-к2')
		elif len(clapan) == 0 and len(str(clapanf)) == 0:
			outlist.append('')
		elif clapan == 0 and len(str(clapanf)) == 0:
			outlist.append('')
		elif clapan == 1 and len(str(clapanf)) == 0:
			outlist.append('-к1')
		elif clapan == 2 and len(str(clapanf)) == 0:
			outlist.append('-к2')
		elif len(str(clapan)) == 0 and clapanf == 0:
			outlist.append('')
		elif len(str(clapan)) == 0 and clapanf == 1:
			outlist.append('-к1ф')
		elif len(str(clapan)) == 0 and clapanf == 2:
			outlist.append('-к2ф')
		else:
			outlist.append('')
	else:
		outlist.append('')
# Назначьте вывод переменной OUT.
OUT = outlist
# ----------------------------------------
setParameterByName_8 = Element.SetParameterByName(element=code_block_6.out0, parameterName=code_block_23, value=python_script_7)
code_block_26 = CodeBlock { "ФОП_Примечание"; }
code_block_27 = CodeBlock { "Примечание"; }
if_2 = RefactoredIf(test=истина_фоп_примечание_ложь, true=code_block_26, false=code_block_27)
python_script_8 = Python(IN[0]=getParameterValueByName_5, IN[1]=getParameterValueByName_6)  # IronPython2; same code as python_script_6
setParameterByName_9 = Element.SetParameterByName(element=code_block_6.out0, parameterName=if_2, value=python_script_8)
code_block_28 = CodeBlock { "ФОП_Примечание"; }
code_block_29 = CodeBlock { "Примечание"; }
if_3 = RefactoredIf(test=истина_фоп_примечание_ложь, true=code_block_28, false=code_block_29)
code_block_30 = CodeBlock { "Клапаны"; }
getParameterValueByName_7 = Element.GetParameterValueByName(element=filterByBoolMask_3.in, parameterName=code_block_30)
code_block_31 = CodeBlock { "Клапаны с фрезеровкой"; }
getParameterValueByName_8 = Element.GetParameterValueByName(element=filterByBoolMask_3.in, parameterName=code_block_31)
python_script_9 = Python(IN[0]=getParameterValueByName_7, IN[1]=getParameterValueByName_8)  # IronPython2; same code as python_script_6
setParameterByName_10 = Element.SetParameterByName(element=filterByBoolMask_3.in, parameterName=if_3, value=python_script_9)
code_block_32 = CodeBlock { "ФОП_Открывание"; }
elementType_3 = Element.ElementType()  # unwired: element
string_from_object_5 = FromObject(object=elementType_3)
python_script_10 = Python(IN[0]=string_from_object_5, IN[1]=getParameterValueByName_7, IN[2]=getParameterValueByName_8)  # IronPython2
# ---------- python_script_10.python (52 lines) ----------
# Загрузить стандартную библиотеку Python и библиотеку DesignScript
import sys
import clr
clr.AddReference('ProtoGeometry')
from Autodesk.DesignScript.Geometry import *

# Введенные в этом узле данные сохраняется в виде списка в переменных IN.
families = IN[0]
clapans = IN[1]
clapansf = IN[2]
outlist = []

# Разместите код под этой строкой
for family, clapan, clapanf in zip(families, clapans, clapansf):
	if clapan == 0 and clapanf == 0:
		outlist.append('')
	elif clapan == 0 and clapanf == 1:
		outlist.append('-к1ф')
	elif clapan == 0 and clapanf == 2:
		outlist.append('-к2ф')
	elif clapan == 1 and clapanf == 0:
		outlist.append('-к1')
	elif clapan == 2 and clapanf == 0:
		outlist.append('-к2')
	elif clapan == 1 and clapanf == 1:
		outlist.append('-к1ф')
	elif clapan == 2 and clapanf == 1:
		outlist.append('-к2ф1')
	elif clapan == 2 and clapanf == 2:
		outlist.append('-к2ф')
	elif clapan == 1 and len(str(clapanf)) == 0:
		outlist.append('-к1')
	elif clapan == 2 and len(str(clapanf)) == 0:
		outlist.append('-к2')
	elif len(str(clapan)) == 0 and len(str(clapanf)) == 0:
		outlist.append('')
	elif clapan == 0 and len(str(clapanf)) == 0:
		outlist.append('')
	elif clapan == 1 and len(str(clapanf)) == 0:
		outlist.append('-к1')
	elif clapan == 2 and len(str(clapanf)) == 0:
		outlist.append('-к2')
	elif len(str(clapan)) == 0 and clapanf == 0:
		outlist.append('')
	elif len(str(clapan)) == 0 and clapanf == 1:
		outlist.append('-к1ф')
	elif len(str(clapan)) == 0 and clapanf == 2:
		outlist.append('-к2ф')
	else:
		outlist.append('')
# Назначьте вывод переменной OUT.
OUT = outlist
# ----------------------------------------
setParameterByName_11 = Element.SetParameterByName(element=filterByBoolMask_3.in, parameterName=code_block_32, value=python_script_10)
