# Dynamo graph script.dyn "Проемы и отверстия в стенах - №3.1_Сквозная маркировка" (Dynamo 2.10.1.3976)

# group: ОПИСАНИЕ! ПРОЧИТАТЬ ПЕРЕД ЗАПУСКОМ!
# note: Скрипт "Проемы и отверстия в стенах - №3_Сквозная маркировка"
# Разработал: Козлов Павел
# ЧТО ДЕЛАЕТ:
# Маркирует отверстия по подготовленному файлу  из ведомости "Экспорт в EXCELL - Спецификация отверстий сквозная" или "Экспорт в EXCELL - Спецификация проемов сквозная"
# КАК ПОЛЬЗОВАТЬСЯ:
# 1. Перед использованием обязательно прогнать скрипты №1, №2
# 2. Экспортировать ведомость в Excell - "Экспорт в EXCELL - Спецификация отверстий сквозная" или "Экспорт в EXCELL - Спецификация проемов сквозная" при помощи BIM-платформы
# 3. Пронумеровать в экселе проемы/отверстия "перетаскиванием" нумерации и сохранить с нужным именем в рабочей папке у себя на компьютере/сервере
# 4. Подгрузить данный файл и запустить скрипт внутри секций
# 5. Обновить секции в сводном файле

python_script = Python()  # IronPython2
# ---------- python_script.python (64 lines) ----------
import clr
clr.AddReference('ProtoGeometry')
clr.AddReference("System.Windows.Forms")
from Autodesk.DesignScript.Geometry import *
clr.AddReference("RevitServices")
import RevitServices
from RevitServices.Persistence import DocumentManager
from RevitServices.Transactions import TransactionManager
clr.AddReference("RevitAPI")
import Autodesk
from Autodesk.Revit.DB import *
doc = DocumentManager.Instance.CurrentDBDocument
uiapp = DocumentManager.Instance.CurrentUIApplication
app = uiapp.Application
from System.Collections.Generic import *
uidoc = DocumentManager.Instance.CurrentUIApplication.ActiveUIDocument
from operator import itemgetter
clr.AddReference("RevitNodes")
import Revit
clr.ImportExtensions(Revit.Elements)
import itertools
from itertools import groupby
import os
import System
from System.Windows.Forms import SaveFileDialog, OpenFileDialog

family_doors_windows = ["Двр_Двр_Однп",
				"Двр_Двр_Двуп",
				"Двр_Про_Проем",
				"Двр_Двр_Ворота",
				"Окн_Про_Проем",				
				"Окн_ББлок_Одностворчатый Фрамуга",
				"Окн_ББлок_Двухстворчатый Фрамуга",
				"Окн_ББлок_Трехстворчатый Фрамуга",
				"Окн_ББлок_Четырехстворчатый Фрамуга",
				"Окн_Окн_Одностворчатое Импост",
				"Окн_Окн_Двухстворчатое Импост",
				"Окн_Окн_Трехстворчатое Импост",
				"Окн_Окн_1 Ств Стандарт",
				"Окн_Окн_2 Ств Стандарт",
				"Окн_Окн_3 Ств Стандарт",
				"Окн_Окн_Одностворчатое",
				"Окн_Окн_Двухстворчатое",
				"Окн_Окн_Трехстворчатое",
				"Окн_Отв_Прямоуг_Стена"]

windows = FilteredElementCollector(doc).OfCategory(BuiltInCategory.OST_Windows).WhereElementIsNotElementType().ToElements()
doors = FilteredElementCollector(doc).OfCategory(BuiltInCategory.OST_Doors).WhereElementIsNotElementType().ToElements()

all_elements = list(itertools.chain(*[windows,doors])) 


openings_list = []
for element in all_elements:
	for family in family_doors_windows:
		try:
			if family in element.get_Parameter(BuiltInParameter.ELEM_FAMILY_PARAM).AsValueString():
				openings_list.append(element)			
		except:
			pass



OUT = openings_list
# ----------------------------------------

# group: ИСХОДНЫЕ ДАННЫЕ
# note: Выбрать заранее подготовленный и пронумерованный файл
выбор_excel_файла = Python()  # IronPython2
# ---------- выбор_excel_файла.python (39 lines) ----------
import clr
clr.AddReference('ProtoGeometry')
clr.AddReference("System.Windows.Forms")
from Autodesk.DesignScript.Geometry import *
clr.AddReference("RevitServices")
import RevitServices
from RevitServices.Persistence import DocumentManager
from RevitServices.Transactions import TransactionManager
clr.AddReference("RevitAPI")
import Autodesk
from Autodesk.Revit.DB import *
doc = DocumentManager.Instance.CurrentDBDocument
uiapp = DocumentManager.Instance.CurrentUIApplication
app = uiapp.Application
from System.Collections.Generic import *
uidoc = DocumentManager.Instance.CurrentUIApplication.ActiveUIDocument
from operator import itemgetter
clr.AddReference("RevitNodes")
import Revit
clr.ImportExtensions(Revit.Elements)
import itertools
from itertools import groupby
import os
import System
from System.Windows.Forms import SaveFileDialog, OpenFileDialog, DialogResult


openFileDialog = OpenFileDialog()

openFileDialog.Title = "Выберите Excel-файл"
openFileDialog.InitialDirectory = "c:\\"
openFileDialog.Filter = "Excel Files|*.xls;*.xlsx;*.xlsm"
openFileDialog.FilterIndex = 1
openFileDialog.RestoreDirectory = True

if openFileDialog.ShowDialog() == DialogResult.OK:
	filePath = openFileDialog.FileName

OUT = filePath
# ----------------------------------------

маркировка = Python(IN[0]=python_script, IN[1]=выбор_excel_файла)  # IronPython2
# ---------- маркировка.python (69 lines) ----------
import clr
clr.AddReference('ProtoGeometry')
clr.AddReference("System.Windows.Forms")
from Autodesk.DesignScript.Geometry import *
clr.AddReference("RevitServices")
import RevitServices
from RevitServices.Persistence import DocumentManager
from RevitServices.Transactions import TransactionManager
clr.AddReference("RevitAPI")
import Autodesk
from Autodesk.Revit.DB import *
doc = DocumentManager.Instance.CurrentDBDocument
uiapp = DocumentManager.Instance.CurrentUIApplication
app = uiapp.Application
from System.Collections.Generic import *
uidoc = DocumentManager.Instance.CurrentUIApplication.ActiveUIDocument
from operator import itemgetter
clr.AddReference("RevitNodes")
import Revit
clr.ImportExtensions(Revit.Elements)
import itertools
from itertools import groupby
import os
import System
from System.Windows.Forms import SaveFileDialog, OpenFileDialog

clr.AddReference("Microsoft.Office.Interop.Excel")
import Microsoft.Office.Interop.Excel as Excel
from System.Runtime.InteropServices import Marshal


def read_from_excel(path):
    excel = Excel.ApplicationClass()
    excel.Visible = False
    excel.DisplayAlerts = False
    names = []
    try:
        workbook = excel.Workbooks.Open(path)
        ws = workbook.Worksheets(1)
        row_end = 200
        
        for i in range(2, row_end):
            if ws.Cells(i, 1).Text:
                names.append ([ws.Cells(i, 1).Text, ws.Cells(i, 2).Text])
            	
    finally:
        excel.ActiveWorkbook.Close(False)
        Marshal.ReleaseComObject(ws)
        Marshal.ReleaseComObject(workbook)
        Marshal.ReleaseComObject(excel)
    return names


list_all_openings = UnwrapElement(IN[0])
path = IN[1]

if path != None:
	excell_data = read_from_excel(path)
	
	TransactionManager.Instance.EnsureInTransaction(doc)
	
	for element in list_all_openings:	
		for data in excell_data:		
			if data[1] == element.LookupParameter('ФОП_Группирование').AsString():			
				element.LookupParameter('ФОП_Марка проема').Set(str(data[0]))			
	
	TransactionManager.Instance.TransactionTaskDone()	

OUT = "Выполнено успешно"
# ----------------------------------------

# group: Для разработчика
python_script_2 = Python()  # IronPython2
# ---------- python_script_2.python (13 lines) ----------
import codecs
import os.path

path = r"T:\Проектный институт\Отдел стандартизации BIM и RD\BIM-Ресурсы\4-Dynamo\Архив\BIM-отдел\Dynamo_new_report.py"

result = ""

if os.path.exists(path):
	with codecs.open(path, 'r', encoding="utf-8") as file:
		for line in file.readlines():
			result += line

OUT = result
# ----------------------------------------
python_script_from_string = PythonStringNode(script=python_script_2)  # IronPython2
